# Grasshopper definition Building Generator.gh (Grasshopper 1.0.7)
# plug-ins: eleFront Rhino 6 Legacy, MetaHopper, Bifocals, LunchBox

# ---- group: Template
# Groups color control
# GROUPS HIERARCHY
# FEM
# TEKLA
# EXCEL
toggle = GroupToggle(ToggleActive=True, ToggleVisible=False)  # disabled

# Plug-in dependency
# List necessary plug-ins to run the script
# List the plugins used that are not part of the Ramboll Packages
# you can run the command _GrasshopperPluginList in Rhino
docinfo = DocumentInfo(AutoUpdate=False, Recursive=False)  # -> DocumentName, DocumentFilePath, Components, Params, _3rdPartyAssemblies
# <SCRIPT TITLE>
# Script Description
# Explain the Basics of the script application here:
# .
# .
# .
# .
# .
# .
# .
panel = Panel(docinfo._3rdPartyAssemblies)

# If applicable, input the related softwares linked to that definition
fem_software_and_version = Panel("SOFiSTiK 2020")
tekla_version_used = Panel("""TS2020
GrasshopperTeklaLink_2020.1.8.1""")

temporary_run_component = Button()
disable_component = BooleanToggle(False)

groups = GetGroups()  # -> Groups, GroupStyles, Nickname, Color
cluster = Cluster_2(all_groups=groups.Groups, disable_component=disable_component, temporary_run_component=temporary_run_component)
# VISUALISATION
# EXPORTS
# IMPORTS
available_coloring_keywords = Panel(cluster)

# ----
crv = Curve(<curve referenced from the Rhino model>)
crv_2 = Curve(<curve referenced from the Rhino model>)
crv_3 = Curve(<curve referenced from the Rhino model>)

# ----
# TEMPLATE AND GOOD PRACTICE TOOLS
# Project #:
# Script Author:  XXX XXX
# Date Created:  XX/XX/2021
toggle_2 = GroupToggle(ToggleActive=True, ToggleVisible=False)  # disabled

number_slider = Slider(5, range=0..15)
number_slider_2 = Slider(8, range=0..15)

# ---- group: Template
# HELP DOCUMENTATION
good_practice_rules = BooleanToggle(False)
template_user_guide = BooleanToggle(False)

# OUTPUTS
# INPUTS
# TEMPLATE
# BASIC GROUP
# LINKS
toggle_3 = GroupToggle(ToggleActive=True, ToggleVisible=False)  # disabled
links_opening = GhPythonScript(y=good_practice_rules, z=template_user_guide)  # -> out, a; inputs y: Boolean, z: Boolean
# ---------- links_opening: Python ----------
__author__ = "AUGC"
__version__ = "2020.08.16"

import rhinoscriptsyntax as rs
import Rhino.Geometry as rg 
import System

GoodP="https://ramboll.sharepoint.com/:b:/r/sites/CODA/Shared%20Documents/General/01_Design_Module_BIM/SIT_GH-Good-Practices.pdf?csf=1&web=1&e=yBAxhZ"
UserG="https://ramboll.sharepoint.com/:b:/r/sites/CODA/Shared%20Documents/General/01_Design_Module_BIM/SIT_GH_Template.pdf?csf=1&web=1&e=8duHDZ"
if y:
    #process.start(GoodP)
    System.Diagnostics.Process.Start(GoodP)
if z:
    System.Diagnostics.Process.Start(UserG)
# ---------- end links_opening ----------

# ----
number_slider_3 = Slider(9, range=0..15)
offset = OffsetCurve(Curve=crv, Distance=Slider(-2, range=-5..5), Corners=1)
offset_2 = OffsetCurve(Curve=crv_2, Distance=Slider(-1, range=-5..5), Corners=1)
offset_3 = OffsetCurve(Curve=crv_3, Distance=Slider(-0.5, range=-5..5), Corners=1)
dim = Dimensions(Surface=offset)  # -> UDimension, VDimension
dim_2 = Dimensions(Surface=offset_2)  # -> UDimension, VDimension
dim_3 = Dimensions(Surface=offset_3)  # -> UDimension, VDimension
division = Division(A=dim.VDimension, B=number_slider)
division_2 = Division(A=dim.UDimension, B=number_slider)
quads = QuadPanels(Surface=offset, UDivisions=division_2, VDivisions=division)
division_3 = Division(A=dim_2.VDimension, B=number_slider_2)
division_4 = Division(A=dim_2.UDimension, B=number_slider_2)
quads_2 = QuadPanels(Surface=offset_2, UDivisions=division_4, VDivisions=division_3)
division_5 = Division(A=dim_3.VDimension, B=number_slider_3)
division_6 = Division(A=dim_3.UDimension, B=number_slider_3)
quads_3 = QuadPanels(Surface=offset_3, UDivisions=division_6, VDivisions=division_5)
grid = GridStructure(Surface=offset, UDivisions=division_2, VDivisions=division)  # -> StructureLines, StructureNodes
area = Area(Geometry=quads)  # -> Area, Centroid
grid_2 = GridStructure(Surface=offset_2, UDivisions=division_4, VDivisions=division_3)  # -> StructureLines, StructureNodes
area_2 = Area(Geometry=offset)  # -> Area, Centroid

# ---- group: Template
# BIFOCALS CONTROL PANEL
# Double click to see the elements types
# METAHOPPER WIRES SHOW
# Shows all the hidden wires
toggle_4 = BooleanToggle(False)
wiretoggle = WireDisplayToggle(ShowHiddenWires=toggle_4)

# ----
area_3 = Area(Geometry=quads_2)  # -> Area, Centroid
area_4 = Area(Geometry=offset_2)  # -> Area, Centroid
grid_3 = GridStructure(Surface=offset_3, UDivisions=division_6, VDivisions=division_5)  # -> StructureLines, StructureNodes
area_5 = Area(Geometry=quads_3)  # -> Area, Centroid
area_6 = Area(Geometry=offset_3)  # -> Area, Centroid
cp = ClosestPoint(Point=area_2.Centroid, Cloud=area.Centroid)  # -> ClosestPoint, CPIndex, Distance
vec = Vector(grid.StructureLines)
cp_2 = ClosestPoint(Point=area_4.Centroid, Cloud=area_3.Centroid)  # -> ClosestPoint, CPIndex, Distance
vec_2 = Vector(grid_2.StructureLines)
cp_3 = ClosestPoint(Point=area_6.Centroid, Cloud=area_5.Centroid)  # -> ClosestPoint, CPIndex, Distance
vec_3 = Vector(grid_3.StructureLines)
pgroups = PointGroups(Points=vec, Distance="0.05")  # -> simplify(Groups), Indices
item = ListItem(List=quads, Index=cp.CPIndex, Wrap=True)
pgroups_2 = PointGroups(Points=vec_2, Distance="0.05")  # -> simplify(Groups), Indices
item_2 = ListItem(List=quads_2, Index=cp_2.CPIndex, Wrap=True)
pgroups_3 = PointGroups(Points=vec_3, Distance="0.05")  # -> simplify(Groups), Indices
item_3 = ListItem(List=quads_3, Index=cp_3.CPIndex, Wrap=True)
crv_4 = Curve(item)
item_4 = ListItem(List=grid.StructureLines, Index=pgroups.Indices, Wrap=True)
crv_5 = Curve(item_2)
item_5 = ListItem(List=grid_2.StructureLines, Index=pgroups_2.Indices, Wrap=True)
crv_6 = Curve(item_3)
item_6 = ListItem(List=grid_3.StructureLines, Index=pgroups_3.Indices, Wrap=True)
offset_4 = OffsetCurve(Curve=crv_4, Distance=Slider(-0.2, range=-5..5), Corners=1)
join = JoinCurves(Curves=item_4, Preserve=False)
offset_5 = OffsetCurve(Curve=crv_5, Distance=Slider(-1, range=-5..5), Corners=1)
join_2 = JoinCurves(Curves=item_5, Preserve=False)

# ---- group: TEMPLATE
# BEST PRACTIZER
# This creates Inputs and outputs at the edges of a group
# 
# 1) Select group to "best Practise"
# 2) Click on "Select" button
# 3) Click on the "Activate"
activate = Button()
bestpracticizer = BestPracticizer(Activate=activate)

# ----
offset_6 = OffsetCurve(Curve=crv_6, Distance=Slider(-0.5, range=-5..5), Corners=1)
join_3 = JoinCurves(Curves=item_6, Preserve=False)
core = Curve(offset_4)
number_slider_4 = Slider(3, range=0..5)
ext = ExtendCurve(Curve=join, Type=0, Start="10", End="10")
core_2 = Curve(offset_5)
number_slider_5 = Slider(3.2, range=0..5)
ext_2 = ExtendCurve(Curve=join_2, Type=0, Start="10", End="10")
core_3 = Curve(offset_6)
ext_3 = ExtendCurve(Curve=join_3, Type=0, Start="10", End="10")
number_slider_6 = Slider(2.8, range=0..5)
trim = TrimWithRegions(Curve=ext, Regions=crv)  # -> Inside, Outside
trim_2 = TrimWithRegions(Curve=ext_2, Regions=crv_2)  # -> Inside, Outside
trim_3 = TrimWithRegions(Curve=ext_3, Regions=crv_3)  # -> Inside, Outside
explode = Explode(Curve=trim.Inside, Recursive=True)  # -> flatten(Segments), Vertices
series = Series(Start=0, Step=number_slider_4, Count=Slider(10, range=0..30))
explode_2 = Explode(Curve=trim_2.Inside, Recursive=True)  # -> flatten(Segments), Vertices
series_2 = Series(Start=0, Step=number_slider_5, Count=Slider(15, range=0..30))
explode_3 = Explode(Curve=trim_3.Inside, Recursive=True)  # -> flatten(Segments), Vertices
series_3 = Series(Start=0, Step=number_slider_6, Count=Slider(20, range=0..30))

# ---- group: TEMPLATE
# CHANGE WIRE DISPLAY
# This change the wire display of the selected objects (It affects the wires before the selected object)
# 
# 1) Select the objects
# 2) Click on "Select" button
# 3) Pick the wire type you want to apply
list = ValueList({"Normal": 0, "Faint": 1, "Hidden": 2}, selected="Faint")
# IMPORTS
# INPUTS
# TEMPLATE
wiredisplay = ControlWireDisplay(WireDisplay=list)

# ----
Z = UnitZ(Factor=series)
Z_2 = UnitZ(Factor=series_2)
Z_3 = UnitZ(Factor=series_3)
move = Move(Geometry=explode.Segments, Motion=graft(Z))  # -> Geometry, Transform
move_2 = Move(Geometry=crv, Motion=graft(Z))  # -> Geometry, Transform
move_3 = Move(Geometry=explode_2.Segments, Motion=graft(Z_2))  # -> Geometry, Transform
move_4 = Move(Geometry=crv_2, Motion=graft(Z_2))  # -> Geometry, Transform
move_5 = Move(Geometry=grid.StructureNodes, Motion=graft(Z))  # -> simplify(Geometry), Transform
move_6 = Move(Geometry=grid_2.StructureNodes, Motion=graft(Z_2))  # -> simplify(Geometry), Transform
move_7 = Move(Geometry=explode_3.Segments, Motion=graft(Z_3))  # -> Geometry, Transform
move_8 = Move(Geometry=crv_3, Motion=graft(Z_3))  # -> Geometry, Transform
core_4 = Curve(core)
move_9 = Move(Geometry=grid_3.StructureNodes, Motion=graft(Z_3))  # -> simplify(Geometry), Transform
core_5 = Curve(core_2)
core_6 = Curve(core_3)
flip = FlipMatrix(Data=move_5.Geometry)
move_10 = Move(Geometry=core_4, Motion=graft(Z))  # -> simplify(flatten(Geometry)), Transform
flip_2 = FlipMatrix(Data=move_6.Geometry)
move_11 = Move(Geometry=core_5, Motion=graft(Z_2))  # -> simplify(flatten(Geometry)), Transform
join_4 = JoinCurves(Curves=move.Geometry, Preserve=False)
boundary = BoundarySurfaces(Edges=move_2.Geometry)
join_5 = JoinCurves(Curves=move_3.Geometry, Preserve=False)
boundary_2 = BoundarySurfaces(Edges=move_4.Geometry)
flip_3 = FlipMatrix(Data=move_9.Geometry)
move_12 = Move(Geometry=core_6, Motion=graft(Z_3))  # -> simplify(flatten(Geometry)), Transform
join_6 = JoinCurves(Curves=move_7.Geometry, Preserve=False)
boundary_3 = BoundarySurfaces(Edges=move_8.Geometry)
pline = PolyLine(Vertices=flip, Closed=False)
pline_2 = PolyLine(Vertices=flip_2, Closed=False)
cull_i = CullIndex(List=move_10.Geometry, Indices="-1", Wrap=True)
pline_3 = PolyLine(Vertices=flip_3, Closed=False)
cull_i_2 = CullIndex(List=move_11.Geometry, Indices="-1", Wrap=True)
Z_4 = UnitZ(Factor=number_slider_4)
Z_5 = UnitZ(Factor=number_slider_5)
cull_i_3 = CullIndex(List=move_12.Geometry, Indices="-1", Wrap=True)
explode_4 = Explode(Curve=pline, Recursive=True)  # -> Segments, Vertices
explode_5 = Explode(Curve=pline_2, Recursive=True)  # -> Segments, Vertices
Z_6 = UnitZ(Factor=number_slider_6)
extr = Extrude(Base=cull_i, Direction=Z_4)
explode_6 = Explode(Curve=pline_3, Recursive=True)  # -> Segments, Vertices
extr_2 = Extrude(Base=cull_i_2, Direction=Z_5)
columns = Curve(explode_4.Segments)
extr_3 = Extrude(Base=cull_i_3, Direction=Z_6)
nodes = Point(grid.StructureNodes)
slabs = Brep(boundary)
beams = Curve(join_4)
columns_2 = Curve(explode_5.Segments)
nodes_2 = Point(grid_2.StructureNodes)
slabs_2 = Brep(boundary_2)
beams_2 = Curve(join_5)
columns_3 = Curve(explode_6.Segments)
nodes_3 = Point(grid_3.StructureNodes)
slabs_3 = Brep(boundary_3)
beams_3 = Curve(join_6)
preview = CustomPreview(Geometry=slabs, Material=ColourSwatch(SwatchColor=RGBA(255, 255, 255, 69)))
preview_2 = CustomPreview(Geometry=slabs_2, Material=ColourSwatch(SwatchColor=RGBA(255, 255, 255, 69)))
preview_3 = CustomPreview(Geometry=columns, Material=ColourSwatch(SwatchColor=RGB(255, 0, 0)))
preview_4 = CustomPreview(Geometry=beams, Material=ColourSwatch(SwatchColor=RGB(0, 111, 255)))
preview_5 = CustomPreview(Geometry=columns_2, Material=ColourSwatch(SwatchColor=RGB(255, 0, 0)))
preview_6 = CustomPreview(Geometry=beams_2, Material=ColourSwatch(SwatchColor=RGB(0, 111, 255)))
preview_7 = CustomPreview(Geometry=extr, Material=ColourSwatch(SwatchColor=RGB(60, 255, 0)))
preview_8 = CustomPreview(Geometry=extr_2, Material=ColourSwatch(SwatchColor=RGB(60, 255, 0)))
preview_9 = CustomPreview(Geometry=slabs_3, Material=ColourSwatch(SwatchColor=RGBA(255, 255, 255, 69)))
preview_10 = CustomPreview(Geometry=columns_3, Material=ColourSwatch(SwatchColor=RGB(255, 0, 0)))
preview_11 = CustomPreview(Geometry=beams_3, Material=ColourSwatch(SwatchColor=RGB(0, 111, 255)))
preview_12 = CustomPreview(Geometry=extr_3, Material=ColourSwatch(SwatchColor=RGB(60, 255, 0)))

building_name = Panel("Building1")
# GROUPINGS COLORS
# OUTPUTS
# EXPORTS
# VISUALISATION
# EXCEL
button = Button()
# TEKLA
building_name_2 = Data(flatten(building_name))

panel_2 = Panel("""Type
BuildingName""")
building_name_3 = Data(flatten(building_name_2))
data = Data(flatten(slabs))
type = Panel("Slab")
concat = Concatenate(FragmentA=building_name_3, FragmentB=type, JoinSeparator="::")
long = LongestList(ListC=data, ListA=building_name_3, ListB=type, PaddingMode=2)  # -> graft(ListC), graft(ListA), graft(ListB)
merge = Merge(Data1=long.ListB, Data2=long.ListA)
attributes_r6 = DefineObjectAttributesR6(UserKeys=panel_2, UserValues=merge, Layer=concat, Color=ColourSwatch(SwatchColor=RGBA(255, 255, 255, 69)))  # -> flatten(Attributes)
# BASIC GROUP
bake_r6 = BakeObjectsR6(Geometry=data, Attributes=attributes_r6, BakeName=concat, Bake=button)

building_name_4 = Data(flatten(building_name_2))
data_2 = Data(flatten(beams))
type_2 = Panel("Beams")
panel_3 = Panel("""Type
BuildingName""")
concat_2 = Concatenate(FragmentA=building_name_4, FragmentB=type_2, JoinSeparator="::")
long_2 = LongestList(ListC=data_2, ListA=building_name_4, ListB=type_2, PaddingMode=2)  # -> graft(ListC), graft(ListA), graft(ListB)
merge_2 = Merge(Data1=long_2.ListB, Data2=long_2.ListA)
attributes_r6_2 = DefineObjectAttributesR6(UserKeys=panel_3, UserValues=merge_2, Layer=concat_2, Color=ColourSwatch(SwatchColor=RGB(0, 111, 255)))  # -> flatten(Attributes)
bake_r6_2 = BakeObjectsR6(Geometry=data_2, Attributes=attributes_r6_2, BakeName=concat_2, Bake=button)

building_name_5 = Data(flatten(building_name_2))
data_3 = Data(flatten(columns))
panel_4 = Panel("""Type
BuildingName""")
type_3 = Panel("Columns")
concat_3 = Concatenate(FragmentA=building_name_5, FragmentB=type_3, JoinSeparator="::")
long_3 = LongestList(ListC=data_3, ListA=building_name_5, ListB=type_3, PaddingMode=2)  # -> graft(ListC), graft(ListA), graft(ListB)
merge_3 = Merge(Data1=long_3.ListB, Data2=long_3.ListA)
attributes_r6_3 = DefineObjectAttributesR6(UserKeys=panel_4, UserValues=merge_3, Layer=concat_3, Color=ColourSwatch(SwatchColor=RGB(255, 0, 0)))  # -> flatten(Attributes)
bake_r6_3 = BakeObjectsR6(Geometry=data_3, Attributes=attributes_r6_3, BakeName=concat_3, Bake=button)

building_name_6 = Data(flatten(building_name_2))
data_4 = Data(flatten(extr))
panel_5 = Panel("""Type
BuildingName""")
type_4 = Panel("Core")
concat_4 = Concatenate(FragmentA=building_name_6, FragmentB=type_4, JoinSeparator="::")
long_4 = LongestList(ListC=data_4, ListA=building_name_6, ListB=type_4, PaddingMode=2)  # -> graft(ListC), graft(ListA), graft(ListB)
merge_4 = Merge(Data1=long_4.ListB, Data2=long_4.ListA)
attributes_r6_4 = DefineObjectAttributesR6(UserKeys=panel_5, UserValues=merge_4, Layer=concat_4, Color=ColourSwatch(SwatchColor=RGB(60, 255, 0)))  # -> flatten(Attributes)
bake_r6_4 = BakeObjectsR6(Geometry=data_4, Attributes=attributes_r6_4, BakeName=concat_4, Bake=button)

building_name_7 = Panel("Building2")
button_2 = Button()
building_name_8 = Data(flatten(building_name_7))

panel_6 = Panel("""Type
BuildingName""")
building_name_9 = Data(flatten(building_name_8))
data_5 = Data(flatten(slabs_2))
type_5 = Panel("Slab")
concat_5 = Concatenate(FragmentA=building_name_9, FragmentB=type_5, JoinSeparator="::")
long_5 = LongestList(ListC=data_5, ListA=building_name_9, ListB=type_5, PaddingMode=2)  # -> graft(ListC), graft(ListA), graft(ListB)
merge_5 = Merge(Data1=long_5.ListB, Data2=long_5.ListA)
attributes_r6_5 = DefineObjectAttributesR6(UserKeys=panel_6, UserValues=merge_5, Layer=concat_5, Color=ColourSwatch(SwatchColor=RGBA(255, 255, 255, 69)))  # -> flatten(Attributes)
bake_r6_5 = BakeObjectsR6(Geometry=data_5, Attributes=attributes_r6_5, BakeName=concat_5, Bake=button_2)

building_name_10 = Data(flatten(building_name_8))
data_6 = Data(flatten(beams_2))
type_6 = Panel("Beams")
panel_7 = Panel("""Type
BuildingName""")
concat_6 = Concatenate(FragmentA=building_name_10, FragmentB=type_6, JoinSeparator="::")
long_6 = LongestList(ListC=data_6, ListA=building_name_10, ListB=type_6, PaddingMode=2)  # -> graft(ListC), graft(ListA), graft(ListB)
merge_6 = Merge(Data1=long_6.ListB, Data2=long_6.ListA)
attributes_r6_6 = DefineObjectAttributesR6(UserKeys=panel_7, UserValues=merge_6, Layer=concat_6, Color=ColourSwatch(SwatchColor=RGB(0, 111, 255)))  # -> flatten(Attributes)
bake_r6_6 = BakeObjectsR6(Geometry=data_6, Attributes=attributes_r6_6, BakeName=concat_6, Bake=button_2)

building_name_11 = Data(flatten(building_name_8))
data_7 = Data(flatten(columns_2))
panel_8 = Panel("""Type
BuildingName""")
type_7 = Panel("Columns")
concat_7 = Concatenate(FragmentA=building_name_11, FragmentB=type_7, JoinSeparator="::")
long_7 = LongestList(ListC=data_7, ListA=building_name_11, ListB=type_7, PaddingMode=2)  # -> graft(ListC), graft(ListA), graft(ListB)
merge_7 = Merge(Data1=long_7.ListB, Data2=long_7.ListA)
attributes_r6_7 = DefineObjectAttributesR6(UserKeys=panel_8, UserValues=merge_7, Layer=concat_7, Color=ColourSwatch(SwatchColor=RGB(255, 0, 0)))  # -> flatten(Attributes)
bake_r6_7 = BakeObjectsR6(Geometry=data_7, Attributes=attributes_r6_7, BakeName=concat_7, Bake=button_2)

building_name_12 = Data(flatten(building_name_8))
data_8 = Data(flatten(extr_2))
panel_9 = Panel("""Type
BuildingName""")
type_8 = Panel("Core")
concat_8 = Concatenate(FragmentA=building_name_12, FragmentB=type_8, JoinSeparator="::")
long_8 = LongestList(ListC=data_8, ListA=building_name_12, ListB=type_8, PaddingMode=2)  # -> graft(ListC), graft(ListA), graft(ListB)
merge_8 = Merge(Data1=long_8.ListB, Data2=long_8.ListA)
attributes_r6_8 = DefineObjectAttributesR6(UserKeys=panel_9, UserValues=merge_8, Layer=concat_8, Color=ColourSwatch(SwatchColor=RGB(60, 255, 0)))  # -> flatten(Attributes)
bake_r6_8 = BakeObjectsR6(Geometry=data_8, Attributes=attributes_r6_8, BakeName=concat_8, Bake=button_2)

building_name_13 = Panel("Building3")
button_3 = Button()
building_name_14 = Data(flatten(building_name_13))

panel_10 = Panel("""Type
BuildingName""")
building_name_15 = Data(flatten(building_name_14))
data_9 = Data(flatten(slabs_3))
type_9 = Panel("Slab")
concat_9 = Concatenate(FragmentA=building_name_15, FragmentB=type_9, JoinSeparator="::")
long_9 = LongestList(ListC=data_9, ListA=building_name_15, ListB=type_9, PaddingMode=2)  # -> graft(ListC), graft(ListA), graft(ListB)
merge_9 = Merge(Data1=long_9.ListB, Data2=long_9.ListA)
attributes_r6_9 = DefineObjectAttributesR6(UserKeys=panel_10, UserValues=merge_9, Layer=concat_9, Color=ColourSwatch(SwatchColor=RGBA(255, 255, 255, 69)))  # -> flatten(Attributes)
bake_r6_9 = BakeObjectsR6(Geometry=data_9, Attributes=attributes_r6_9, BakeName=concat_9, Bake=button_3)

building_name_16 = Data(flatten(building_name_14))
data_10 = Data(flatten(beams_3))
type_10 = Panel("Beams")
panel_11 = Panel("""Type
BuildingName""")
concat_10 = Concatenate(FragmentA=building_name_16, FragmentB=type_10, JoinSeparator="::")
long_10 = LongestList(ListC=data_10, ListA=building_name_16, ListB=type_10, PaddingMode=2)  # -> graft(ListC), graft(ListA), graft(ListB)
merge_10 = Merge(Data1=long_10.ListB, Data2=long_10.ListA)
attributes_r6_10 = DefineObjectAttributesR6(UserKeys=panel_11, UserValues=merge_10, Layer=concat_10, Color=ColourSwatch(SwatchColor=RGB(0, 111, 255)))  # -> flatten(Attributes)
bake_r6_10 = BakeObjectsR6(Geometry=data_10, Attributes=attributes_r6_10, BakeName=concat_10, Bake=button_3)

building_name_17 = Data(flatten(building_name_14))
data_11 = Data(flatten(columns_3))
panel_12 = Panel("""Type
BuildingName""")
type_11 = Panel("Columns")
concat_11 = Concatenate(FragmentA=building_name_17, FragmentB=type_11, JoinSeparator="::")
long_11 = LongestList(ListC=data_11, ListA=building_name_17, ListB=type_11, PaddingMode=2)  # -> graft(ListC), graft(ListA), graft(ListB)
merge_11 = Merge(Data1=long_11.ListB, Data2=long_11.ListA)
attributes_r6_11 = DefineObjectAttributesR6(UserKeys=panel_12, UserValues=merge_11, Layer=concat_11, Color=ColourSwatch(SwatchColor=RGB(255, 0, 0)))  # -> flatten(Attributes)
bake_r6_11 = BakeObjectsR6(Geometry=data_11, Attributes=attributes_r6_11, BakeName=concat_11, Bake=button_3)

building_name_18 = Data(flatten(building_name_14))
data_12 = Data(flatten(extr_3))
panel_13 = Panel("""Type
BuildingName""")
type_12 = Panel("Core")
concat_12 = Concatenate(FragmentA=building_name_18, FragmentB=type_12, JoinSeparator="::")
long_12 = LongestList(ListC=data_12, ListA=building_name_18, ListB=type_12, PaddingMode=2)  # -> graft(ListC), graft(ListA), graft(ListB)
merge_12 = Merge(Data1=long_12.ListB, Data2=long_12.ListA)
attributes_r6_12 = DefineObjectAttributesR6(UserKeys=panel_13, UserValues=merge_12, Layer=concat_12, Color=ColourSwatch(SwatchColor=RGB(60, 255, 0)))  # -> flatten(Attributes)
bake_r6_12 = BakeObjectsR6(Geometry=data_12, Attributes=attributes_r6_12, BakeName=concat_12, Bake=button_3)

# ==== cluster Cluster_2
button = Button()
toggle = BooleanToggle(False)
temporary_run_component = ClusterInput()
disable_component = ClusterInput()
all_groups = ClusterInput()
temporary_run_component_2 = Boolean(temporary_run_component)
disable_component_2 = Boolean(disable_component)
all_groups_2 = Data(all_groups)
xor = GateXor(A=disable_component_2, B=temporary_run_component_2)
gate = StreamGate(Stream=all_groups_2, Gate=xor)  # -> Target0, Target1
panel = Panel("AA")  # disabled
objfromgroup = GetObjectsInGroup()  # disabled
objbynn = GetObjectByNickname(NickName=panel)  # disabled
objfromgroup_2 = GetObjectsInGroup(Group=objbynn)  # disabled
txt = Text(["Grasshopper.Kernel.Components.GH_TextTagComponent", "Grasshopper.Kernel.Components.GH_TextTag3DComponent", "DimensionComponents.Component_AlignedDimension", "DimensionComponents.Component_LineDimension", "DimensionComponents.Component_LinearDimension", "DimensionComponents.Component_MarkerDimension", "DimensionComponents.Component_SerialDimension", "DimensionComponents.Component_AngularSimpleDimension", "DimensionComponents.Component_AngularArcDimension", "DimensionComponents.Component_AngularCircleDimension", "MathComponents.ColourComponents.Component_CreateOGLMaterial", "Grasshopper.Kernel.Components.GH_CustomPreviewComponent", "VectorComponents.PointComponents.Component_CloudDisplay", "VectorComponents.PointComponents.Component_DotDisplay", "DimensionComponents.Component_PointListDisplay", "DimensionComponents.Component_PointOrderDisplay", "VectorComponents.VectorComponents.Component_VectorDisplay", "VectorComponents.VectorComponents.Component_VectorDisplay2"])  # disabled
merge = Merge(Data1=txt, Data2=objfromgroup_2)  # -> flatten(Result); disabled

# ---- group: Karamba groups
karamba = Text(["Karamba.GHopper.Licenses.Component_License", "Karamba.GHopper.Models.Component_AssembleModel", "Karamba.GHopper.Models.Component_ConnectedParts", "Karamba.GHopper.Models.Component_DissembleModel", "Karamba.GHopper.Models.Component_ElementActivate", "Karamba.GHopper.Elements.Component_LineToBeam"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])
sofistik = Text(["gh_sofistik.General.GH_Project_Component", "gh_sofistik.General.CreateAnalysisInput", "gh_sofistik.General.GH_ReadSpreadsheet_Component", "gh_sofistik.General.TextStream", "gh_sofistik.Section.CreateAquaInput", "gh_sofistik.Section.GH_ReadSectionCdb_Component", "gh_sofistik.Section.JSON.GH_ReadSectionJSON_Component", "gh_sofistik.Section.GH_SectionFromBrep_Component", "gh_sofistik.Section.GH_CompositeSection_Component", "gh_sofistik.Section.GH_ModifySection_Component", "gh_sofistik.Section.GH_ViewSection_Component", "gh_sofistik.Structure.CreateSofimshcInput", "gh_sofistik.Structure.GH_StructuralArea_Component", "gh_sofistik.Structure.GH_StructuralLine_Component", "gh_sofistik.Structure.GH_StructuralPoint_Component", "gh_sofistik.Structure.GH_BridgeBearing_Component", "gh_sofistik.Structure.GH_ElasticCoupling_Component", "gh_sofistik.Structure.GH_Coupling_Component", "gh_sofistik.Structure.GH_Spring_Component", "gh_sofistik.Load.CreateSofiloadInput", "gh_sofistik.Load.GH_AreaLoad_Component", "gh_sofistik.Load.GH_LineLoad_Component", "gh_sofistik.Load.GH_PointLoad_Component", "gh_sofistik.Geometry.CreateGeometricAxis", "gh_sofistik.AxisModeling.GH_SecondaryAxis_Interpolator_Component", "gh_sofistik.Geometry.GH_ReadGeometricAxisCdb_Component", "gh_sofistik.Geometry.GH_ReadLandXML_Component", "gh_sofistik.Geometry.GH_CurveReparameterize_Component", "gh_sofistik.Geometry.GH_AlignmentAxis_Component", "gh_sofistik.Geometry.GH_AlignmentAxisHorizontal_Component", "gh_sofistik.Geometry.GH_AlignmentAxisVertical_Component", "gh_sofistik.AxisModeling.GH_Axis_Component", "gh_sofistik.AxisModeling.GH_AxisPlacementByParams_Component", "gh_sofistik.AxisModeling.GH_AxisPlacementByPlane_Component", "gh_sofistik.AxisModeling.GH_PlacementTransform_Component", "gh_sofistik.AxisModeling.GH_AxisVariableCustomized_Parameter", "gh_sofistik.AxisModeling.GH_EvaluateVariable_Component", "gh_sofistik.AxisModeling.GH_AxisVariableByExpression_Component", "gh_sofistik.AxisModeling.GH_AxisVariableByPoints_Component", "gh_sofistik.AxisModeling.GH_EvaluateSection_Component", "gh_sofistik.AxisModeling.GH_Curve_Interpolator_Component", "gh_sofistik.AxisModeling.GH_Solid_Interpolator_Component", "gh_sofistik.AxisModeling.GH_Face_Interpolator_Component", "gh_sofistik.Tendon.CreateTendonInput", "gh_sofistik.Tendon.GH_TendonGeometryExternal_Component", "gh_sofistik.Tendon.GH_TendonGeometrySpline_Component", "gh_sofistik.Tendon.GH_TendonGeometryStraight_Component", "gh_sofistik.Tendon.GH_TendonDefinition_Component"])
panel_2 = Panel("""Karamba
Fem
Lusas
Rfem
Sofistik""")
merge_2 = Merge(Data1=karamba, Data2=sofistik)  # -> flatten(Result)
txt_2 = Text(merge_2)
col = Colour(RGBA(225, 0, 26, 150))
data = Data(gate.Target0)
case = TextCase(Text=panel_2, Culture=127)  # -> UpperCase, LowerCase
merge_3 = Merge(Data1=panel_2, Data2=case.UpperCase, Data3=case.LowerCase)
group_names = Text(merge_3)

# ---- group: Ramboll logo and bifocals group
data_2 = Data(gate.Target0)
col_2 = Colour(RGBA(255, 255, 255, 150))
panel_3 = Panel("""Ramboll 
Template""")
selobj = GetSelectedObjects()  # -> ComponentObjects, ParamObjects, OtherObjects
txt_3 = Text(["Bifocals.BifocalsComponent", "Grasshopper.Kernel.Special.GH_Markup"])
sametype = GetObjectsOfSameType(Objects=selobj.ComponentObjects)
samelib = GetObjectsOfSameLibrary(Objects=selobj.ComponentObjects)
case_2 = TextCase(Text=panel_3, Culture=127)  # -> UpperCase, LowerCase
merge_4 = Merge(Data1=txt_3, Data2=samelib, Data3=sametype)
merge_5 = Merge(Data1=panel_3, Data2=case_2.UpperCase, Data3=case_2.LowerCase)
group_names_2 = Text(merge_5)

# ---- group: Tekla groups
col_3 = Colour(RGBA(54, 53, 69, 150))
data_3 = Data(gate.Target0)
txt_4 = Text(["GTLink.Components.CreateSteelBeamComponent", "GTLink.Components.CreateSteelBeam2PtComponent", "GTLink.Components.CreateSteelColumnComponent", "GTLink.Components.CreatePlateComponent", "GTLink.Components.CreateConcreteBeamComponent", "GTLink.Components.CreateConcreteBeam2PtComponent", "GTLink.Components.CreateConcreteColumnComponent", "GTLink.Components.CreatePadFootingComponent", "GTLink.Components.CreatePanelComponent", "GTLink.Components.CreateSlabComponent", "GTLink.Components.CreateStripFootingComponent", "GTLink.Components.CreateSingleRebarComponent", "GTLink.Components.CreateRebarGroupComponent", "GTLink.Components.ExtrudeBeamsComponent", "GTLink.Components.CreateFittingComponent", "GTLink.Components.CreateBooleanPartComponent", "GTLink.Components.CreateCutPlaneComponent", "GTLink.Components.CreateComponentComponent", "GTLink.Components.CreateGridComponent", "GTLink.Components.CreatePointComponent", "GTLink.Components.ComponentCatalogComponent", "GTLink.Components.MaterialCatalogComponent", "GTLink.Components.ProfileCatalogComponent", "GTLink.Components.ReinfocementCatalogComponent", "GTLink.Components.DeformingAttributesComponent", "GTLink.Components.NumberingAttributesComponent", "GTLink.Components.PartAttributesComponent", "GTLink.Components.PositionComponent", "GTLink.Components.CoverAttributesComponent", "GTLink.Components.RebarGroupAttributesComponent", "GTLink.Components.HookAttributesComponent", "GTLink.Components.HooksAttributesComponent", "GTLink.Components.RebarAttributesComponent", "GTLink.Components.ComponentInputComponent", "GTLink.Components.GetBeamComponent", "GTLink.Components.GetComponentComponent", "GTLink.Components.GetItemComponent", "GTLink.Components.GetModelObjectComponent", "GTLink.Components.GetPlateComponent", "GTLink.Components.GetPointComponent", "GTLink.Components.ConvertToBrepComponent", "GTLink.Components.ProfileContour"])
case_3 = TextCase(Text="Tekla", Culture=127)  # -> UpperCase, LowerCase
merge_6 = Merge(Data1="Tekla", Data2=case_3.UpperCase, Data3=case_3.LowerCase)
group_names_3 = Text(merge_6)

# ---- group: Import
import = Text(["IOComponents.Rhino3dmImporter", "IOComponents.PointImporter", "IOComponents.ShapeFileImporter", "IOComponents.PDBFileImporter", "IOComponents.ImageImporter", "Grasshopper.Kernel.Components.GH_ReadFileComponent", "Elefront.Component.Reference.Component_RefBake", "Elefront.Component.Reference.Component_RefColor", "Elefront.Component.Reference.Component_RefLayer", "Elefront.Component.Reference.Component_RefName", "Elefront.Component.Reference.Component_RefType", "Elefront.Component.Reference.Component_RefAtt"])
data_4 = Data(gate.Target0)
col_4 = Colour(RGBA(0, 78, 255, 150))
panel_4 = Panel("""Import
Imports""")
case_4 = TextCase(Text=panel_4, Culture=127)  # -> UpperCase, LowerCase
merge_7 = Merge(Data1=panel_4, Data2=case_4.UpperCase, Data3=case_4.LowerCase)
group_names_4 = Text(merge_7)

# ----
data_5 = Data(gate.Target0)
col_5 = Colour(RGBA(0, 0, 0, 38))
group = Text("Grasshopper.Kernel.Special.GH_Group")
panel_5 = Panel(""".
-""")
group_names_5 = Text(panel_5)

# ---- group: Output groups
data_6 = Data(gate.Target0)
col_6 = Colour(RGBA(137, 255, 255, 150))
panel_6 = Panel("""Output
Outputs""")
case_5 = TextCase(Text=panel_6, Culture=127)  # -> UpperCase, LowerCase
merge_8 = Merge(Data1=panel_6, Data2=case_5.UpperCase, Data3=case_5.LowerCase)
group_names_6 = Text(merge_8)

# ---- group: Input groups
txt_5 = Text(["Grasshopper.Kernel.Special.GH_NumberSlider", "Grasshopper.Kernel.Special.GH_BooleanToggle", "Grasshopper.Kernel.Special.GH_DialKnob", "Grasshopper.Kernel.Special.GH_DigitScroller", "Grasshopper.Kernel.Special.GH_ValueList", "Grasshopper.Kernel.Special.GH_ButtonObject", "Grasshopper.Kernel.Special.GH_MultiDimensionalSlider", "Grasshopper.Kernel.Special.GH_GradientControl", "Grasshopper.Kernel.Special.GH_ImageSampler", "MathComponents.TimeComponents.CalendarObject", "MathComponents.TimeComponents.ClockObject", "Grasshopper.Kernel.Special.GH_ColourPickerObject", "Grasshopper.Kernel.Special.GH_ColourSwatch", "Grasshopper.Kernel.Special.GH_ColourWheel", "Grasshopper.Kernel.Special.GH_GraphMapper", "IOComponents.AtomExtractor", "IOComponents.Rhino3dmImporter", "IOComponents.PointImporter", "IOComponents.ImageImporter", "IOComponents.PDBFileImporter", "IOComponents.ShapeFileImporter", "IOComponents.ReferencedObjectDetailsComponent", "Grasshopper.Kernel.Components.GH_ReadFileComponent"])
col_7 = Colour(RGBA(0, 0, 255, 150))
data_7 = Data(gate.Target0)
panel_7 = Panel("""Inputs
Input""")
panel_8 = Panel("""Inputs
Input
INPUT
INPUTS
input
inputs""")
case_6 = TextCase(Text=panel_7, Culture=127)  # -> UpperCase, LowerCase
merge_9 = Merge(Data1=panel_7, Data2=case_6.UpperCase, Data3=case_6.LowerCase)
group_names_7 = Text(merge_9)

# ---- group: Export
data_8 = Data(gate.Target0)
col_8 = Colour(RGBA(118, 0, 255, 150))
export = Text(["LunchBox.WF_Bake", "LunchBox.WF_Save", "Elefront.Component.Attributes.BakeAtt", "Elefront.Component.Attributes.Component_BakeLayer"])
panel_9 = Panel("""Export
Exports""")
case_7 = TextCase(Text=panel_9, Culture=127)  # -> UpperCase, LowerCase
merge_10 = Merge(Data1=panel_9, Data2=case_7.UpperCase, Data3=case_7.LowerCase)
group_names_8 = Text(merge_10)

# ---- group: Custom preview groups
col_9 = Colour(RGBA(255, 0, 255, 150))
data_9 = Data(gate.Target0)
txt_6 = Text(["Grasshopper.Kernel.Components.GH_TextTagComponent", "Grasshopper.Kernel.Components.GH_TextTag3DComponent", "DimensionComponents.Component_AlignedDimension", "DimensionComponents.Component_LineDimension", "DimensionComponents.Component_LinearDimension", "DimensionComponents.Component_MarkerDimension", "DimensionComponents.Component_SerialDimension", "DimensionComponents.Component_AngularSimpleDimension", "DimensionComponents.Component_AngularArcDimension", "DimensionComponents.Component_AngularCircleDimension", "MathComponents.ColourComponents.Component_CreateOGLMaterial", "Grasshopper.Kernel.Components.GH_CustomPreviewComponent", "VectorComponents.PointComponents.Component_CloudDisplay", "VectorComponents.PointComponents.Component_DotDisplay", "DimensionComponents.Component_PointListDisplay", "DimensionComponents.Component_PointOrderDisplay", "VectorComponents.VectorComponents.Component_VectorDisplay", "VectorComponents.VectorComponents.Component_VectorDisplay2", "Human.CustomPreviewLineWeights", "Human.CurveToScreen", "Human.PointToScreen", "Human.ScreenOrientedMesh", "Human.ScreenToWorldTag", "Human.CustomPreviewMaterials", "Human.MeshToScreen", "Human.TextToScreen", "Human.ScreenOrientedText"])
panel_10 = Panel("""Preview
Visualisation
Visualization""")
case_8 = TextCase(Text=panel_10, Culture=127)  # -> UpperCase, LowerCase
merge_11 = Merge(Data1=panel_10, Data2=case_8.UpperCase, Data3=case_8.LowerCase)
group_names_9 = Text(merge_11)

# ---- group: Excel groups
data_10 = Data(gate.Target0)
txt_7 = Text(["CORE.Grasshopper.Toolbox.readExcelSheet", "CORE.Grasshopper.Toolbox.writeToExcel", "CORE.Grasshopper.Toolbox.WriteOptions"])
col_10 = Colour(RGBA(33, 115, 70, 150))
case_9 = TextCase(Text="Excel", Culture=127)  # -> UpperCase, LowerCase
merge_12 = Merge(Data1="Excel", Data2=case_9.UpperCase, Data3=case_9.LowerCase)
group_names_10 = Text(merge_12)

# ----
entwine = Entwine(
    Branch00=group_names,
    Branch01=group_names_3,
    Branch02=group_names_10,
    Branch03=group_names_9,
    Branch04=group_names_2,
    Branch05=group_names_7,
    Branch06=group_names_6,
    Branch07=group_names_5,
    Branch08=group_names_8,
    Branch09=group_names_4,
    FlattenInputs=True)
R = ClusterOutput(entwine)
all_group_names = Text(flatten(entwine))

# ---- group: Karamba groups (continued)
all_group_names_2 = Text(all_group_names)
cluster = Cluster(
    all_groups=data,
    objects=txt_2,
    colour=col,
    group_names=merge_3,
    all_group_names=all_group_names_2,
    color_groups_of_groups=Toggle(True))  # -> groups_2, already_colored
txt_8 = Text(cluster.groups_2)

# ----
group_coloring_rules = Boolean(cluster.already_colored)

# ---- group: Tekla groups (continued)
group_coloring_rules_2 = Boolean(group_coloring_rules)
all_group_names_3 = Text(all_group_names)
cluster_2 = Cluster(
    all_groups=data_3,
    objects=txt_4,
    colour=col_3,
    group_names=merge_6,
    all_group_names=all_group_names_3,
    other_groups_coloring_rules=group_coloring_rules_2,
    color_groups_of_groups=Toggle(True))  # -> groups_2, already_colored
group_coloring_rules_3 = Boolean(cluster_2.already_colored)
txt_9 = Text(cluster_2.groups_2)

# ---- group: Excel groups (continued)
group_coloring_rules_4 = Boolean(group_coloring_rules_3)
all_group_names_4 = Text(all_group_names)
cluster_3 = Cluster(
    all_groups=data_10,
    objects=txt_7,
    colour=col_10,
    group_names=merge_12,
    all_group_names=all_group_names_4,
    other_groups_coloring_rules=group_coloring_rules_4,
    color_groups_of_groups=Toggle(True))  # -> groups_2, already_colored
group_coloring_rules_5 = Boolean(cluster_3.already_colored)
txt_10 = Text(cluster_3.groups_2)

# ---- group: Custom preview groups (continued)
group_coloring_rules_6 = Boolean(group_coloring_rules_5)
all_group_names_5 = Text(all_group_names)
cluster_4 = Cluster(
    all_groups=data_9,
    objects=txt_6,
    colour=col_9,
    group_names=merge_11,
    all_group_names=all_group_names_5,
    other_groups_coloring_rules=group_coloring_rules_6)  # -> groups_2, already_colored
txt_11 = Text(cluster_4.groups_2)
group_coloring_rules_7 = Boolean(cluster_4.already_colored)

# ---- group: Export (continued)
group_coloring_rules_8 = Boolean(group_coloring_rules_7)
all_group_names_6 = Text(all_group_names)
cluster_5 = Cluster(
    all_groups=data_8,
    objects=export,
    colour=col_8,
    group_names=merge_10,
    all_group_names=all_group_names_6,
    other_groups_coloring_rules=group_coloring_rules_8)  # -> groups_2, already_colored
group_coloring_rules_9 = Boolean(cluster_5.already_colored)
txt_12 = Text(cluster_5.groups_2)

# ---- group: Import (continued)
group_coloring_rules_10 = Boolean(group_coloring_rules_9)
all_group_names_7 = Text(all_group_names)
cluster_6 = Cluster(
    all_groups=data_4,
    objects=import,
    colour=col_4,
    group_names=merge_7,
    all_group_names=all_group_names_7,
    other_groups_coloring_rules=group_coloring_rules_10)  # -> groups_2, already_colored
group_coloring_rules_11 = Boolean(cluster_6.already_colored)
txt_13 = Text(cluster_6.groups_2)

# ---- group: Output groups (continued)
group_coloring_rules_12 = Boolean(group_coloring_rules_11)
all_group_names_8 = Text(all_group_names)
cluster_7 = Cluster(
    all_groups=data_6,
    colour=col_6,
    group_names=merge_8,
    all_group_names=all_group_names_8,
    other_groups_coloring_rules=group_coloring_rules_12)  # -> groups_2, already_colored
group_coloring_rules_13 = Boolean(cluster_7.already_colored)
txt_14 = Text(cluster_7.groups_2)

# ----
group_coloring_rules_14 = Boolean(group_coloring_rules_13)
all_group_names_9 = Text(all_group_names)
cluster_8 = Cluster(
    all_groups=data_5,
    colour=col_5,
    group_names=panel_5,
    all_group_names=all_group_names_9,
    other_groups_coloring_rules=group_coloring_rules_14)  # -> groups_2, already_colored
group_coloring_rules_15 = Boolean(cluster_8.already_colored)
txt_15 = Text(cluster_8.groups_2)

# ---- group: Input groups (continued)
group_coloring_rules_16 = Boolean(group_coloring_rules_15)
all_group_names_10 = Text(all_group_names)
cluster_9 = Cluster(
    all_groups=data_7,
    objects=txt_5,
    colour=col_7,
    group_names=merge_9,
    all_group_names=all_group_names_10,
    other_groups_coloring_rules=group_coloring_rules_16)  # -> groups_2, already_colored
group_coloring_rules_17 = Boolean(cluster_9.already_colored)
txt_16 = Text(cluster_9.groups_2)

# ---- group: Ramboll logo and bifocals group (continued)
group_coloring_rules_18 = Boolean(group_coloring_rules_17)
all_group_names_11 = Text(all_group_names)
cluster_10 = Cluster(
    all_groups=data_2,
    objects=merge_4,
    colour=col_2,
    group_names=merge_5,
    all_group_names=all_group_names_11,
    other_groups_coloring_rules=group_coloring_rules_18)  # -> groups_2, already_colored
group_coloring_rules_19 = Boolean(cluster_10.already_colored)
txt_17 = Text(cluster_10.groups_2)

# ---- group: Other groups
data_11 = Data(gate.Target0)
col_11 = Colour(RGBA(0, 0, 0, 38))
merge_13 = Merge(
    Data1=txt_8,
    Data2=txt_9,
    Data3=txt_10,
    Data4=txt_11,
    Data5=txt_17,
    Data7=txt_16,
    Data8=txt_14,
    Data9=txt_15,
    Data10=txt_12,
    Data11=txt_13)
tstat = TreeStatistics(Tree=merge_13)  # -> Paths, Length, Count
split = SplitTree(Data=simplify(graft(data_11)), Masks=flatten(tstat.Paths))  # -> Positive, Negative
setgroup = SetGroupProperties(Group=split.Negative, Color=col_11)

# ==== cluster Cluster
color_groups_of_groups = ClusterInput()  # Color Groups of groups?

other_groups_coloring_rules = ClusterInput()  # Other groups coloring rules
all_group_names = ClusterInput()  # All Group names
all_groups = ClusterInput()
group_names = ClusterInput()
objects = ClusterInput()
colour = ClusterInput()

bool = Boolean(color_groups_of_groups)
all_group_names_2 = Text(all_group_names)
group_names_2 = Text(group_names)
all_groups_2 = Data(all_groups)
bool_2 = Boolean(other_groups_coloring_rules)
objects_2 = Text(objects)
colour_2 = Colour(colour)

bool_3 = Boolean(bool)
null = NullItem(Item=bool_3)  # -> NullFlags, InvalidFlags, Description
filter = StreamFilter(Gate=null.InvalidFlags, Stream0=bool_3, Stream1=Toggle(False))
color_groups_of_groups_2 = Boolean(filter)

# ----
# Dos the groups has a name from the name list?
group_names_3 = Text(group_names_2)
all_groups_3 = Data(all_groups_2)
all_group_names_3 = Text(all_group_names_2)
object_info = ObjectInfo(Objects=all_groups_3)  # -> Name, NickName, Type, Pivot, Bounds, Value, Enabled, Preview
eval = Evaluate(F="Contains(x, y)", x=graft(object_info.NickName), y=all_group_names_3)
eval_2 = Evaluate(F="Contains(x, y)", x=graft(object_info.NickName), y=group_names_3)
ma = MassAddition(Input=eval_2)  # -> Result, PartialResults
ma_2 = MassAddition(Input=eval)  # -> Result, PartialResults
len = TextLength(Text=object_info.NickName)
group_has_matching_name = Boolean(simplify(ma.Result))
group_has_matching_all_name = Boolean(simplify(ma_2.Result))
group_has_name = Boolean(simplify(graft(len)))

# ----
# Does the group has objects from the object list?
all_groups_4 = Data(all_groups_2)
objects_3 = Text(objects)
objfromgroup = GetObjectsInGroup(Group=all_groups_4)  # -> simplify(Objects)
txt = Text(objfromgroup)
intersection = SetIntersection(SetA=txt, SetB=objects_3)
lng = ListLength(List=intersection)
group_has_object_bool = Boolean(lng)

objects_4 = Text(objects_2)
null_2 = NullItem(Item=objects_4)  # -> NullFlags, InvalidFlags, Description
ma_3 = MassAddition(Input=null_2.InvalidFlags)  # -> Result, PartialResults
bool_4 = Boolean(simplify(ma_3.Result))

# ----
# Does the group contains other groups?
all_groups_5 = Data(all_groups_2)
objfromgroup_2 = GetObjectsInGroup(Group=all_groups_5)  # -> simplify(Objects)
object_info_2 = ObjectInfo(Objects=objfromgroup_2)  # -> Name, NickName, Type, Pivot, Bounds, Value, Enabled, Preview
txt_2 = Text(flatten(object_info_2.Name))
# Changes colour of the group that includes the input objects.
panel = Panel(txt_2)
expression = Expression(x=panel, y="Group", Expression="Contains(x,y)")
unflatten = UnflattenTree(Tree=expression, Guide=object_info_2.Name)
ma_4 = MassAddition(Input=unflatten)  # -> Result, PartialResults
larger = LargerThan(FirstNumber=ma_4.Result, SecondNumber="0")  # -> LargerThan, OrEqualTo
other_groups_contained = Boolean(larger.LargerThan)

other_groups_contained_2 = Boolean(other_groups_contained)
color_the_group = Boolean(group_has_object_bool)
color_groups_of_groups_3 = Boolean(color_groups_of_groups_2)
python = GhPythonScript(x=color_the_group, y=other_groups_contained_2)  # -> out, a; inputs x: Boolean, y: Boolean
# ---------- python: Python ----------
__author__ = "AUGC"
__version__ = "2020.08.16"

import rhinoscriptsyntax as rs
import Rhino.Geometry as rg 
if x and not y: 
    a= 1
else :
    a= 0
# ---------- end python ----------
bool_5 = Boolean(python.a)
filter_2 = StreamFilter(Gate=color_groups_of_groups_3, Stream0=bool_5, Stream1=color_the_group)
color_the_group_2 = Boolean(filter_2)

# ----
# Give priority to the naming (If the group has a Name from the
# All name list, the objects it contains are ignored)
toggle = BooleanToggle(False)
group_has_matching_name_2 = Boolean(simplify(group_has_matching_name))
group_has_matching_all_name_2 = Boolean(simplify(group_has_matching_all_name))
group_has_object_bool_2 = Boolean(simplify(color_the_group_2))
long = LongestList(ListA=group_has_object_bool_2, ListB=toggle, PaddingMode=2)  # -> ListA, ListB
p_n_c = PickNChoose(Pattern=group_has_matching_all_name_2, Stream0=group_has_object_bool_2, Stream1=long.ListB)
or = GateOr(A=p_n_c, B=group_has_matching_name_2)
bool_6 = Boolean(simplify(bool_4))
filter_3 = StreamFilter(Gate=bool_6, Stream0=or, Stream1=group_has_matching_name_2)
color_the_group_3 = Boolean(filter_3)

# ----
# Has the groups already been colored by a color of higher priority
bool_7 = Boolean(bool_2)
bool_8 = Boolean(color_the_group_3)
null_3 = NullItem(Item=bool_7)  # -> NullFlags, flatten(InvalidFlags), Description
long_2 = LongestList(ListA=bool_8, ListB=Toggle(False), PaddingMode=2)  # -> ListA, ListB
item = ListItem(List=null_3.InvalidFlags, Index=0, Wrap=True)
filter_4 = StreamFilter(Gate=item, Stream0=bool_7, Stream1=long_2.ListB)

# ----
# Color the group?
# + update list of colored groups
bool_9 = Boolean(filter_4)
bool_10 = Boolean(color_the_group_3)
expression_2 = Expression(x=bool_9, y=bool_10, Expression="if(x=TRUE,FALSE,y)")
or_2 = GateOr(A=bool_10, B=bool_9)

bool_11 = Boolean(expression_2)
dispatch = Dispatch(List=simplify(graft(all_groups_2)), DispatchPattern=bool_11)  # -> ListA, ListB
clean = CleanTree(RemoveNulls=True, RemoveInvalid=True, RemoveEmpty=True, Tree=dispatch.ListA)
object_info_3 = ObjectInfo(Objects=clean)  # -> Name, NickName, Type, Pivot, Bounds, Value, Enabled, Preview
setgroup = SetGroupProperties(Group=clean, Color=colour_2)
groups = Text(object_info_3.Type)
bool_12 = Boolean(or_2)
groups_2 = ClusterOutput(groups)
already_colored = ClusterOutput(bool_12)  # Already Colored ?
