# Grasshopper definition Building Teklaer.gh (Grasshopper 1.0.7)
# plug-ins: MetaHopper, Bifocals, eleFront Rhino 6 Legacy, Grasshopper-Tekla Link 2021.1.14

# ---- group: Template
# Groups color control
# GROUPS HIERARCHY
# FEM
# TEKLA
# EXCEL
toggle = GroupToggle(ToggleActive=True, ToggleVisible=False)  # disabled

# Plug-in dependency
# List necessary plug-ins to run the script
# List the plugins used that are not part of the Ramboll Packages
# you can run the command _GrasshopperPluginList in Rhino
docinfo = DocumentInfo(AutoUpdate=False, Recursive=False)  # -> DocumentName, DocumentFilePath, Components, Params, _3rdPartyAssemblies
# <SCRIPT TITLE>
# Script Description
panel = Panel(docinfo._3rdPartyAssemblies)

# If applicable, input the related softwares linked to that definition
fem_software_and_version = Panel("SOFiSTiK 2020")
tekla_version_used = Panel("""TS2020
GrasshopperTeklaLink_2020.1.8.1""")

temporary_run_component = Button()
disable_component = BooleanToggle(False)

groups = GetGroups()  # -> Groups, GroupStyles, Nickname, Color
cluster = Cluster_2(all_groups=groups.Groups, disable_component=disable_component, temporary_run_component=temporary_run_component)
# VISUALISATION
# EXPORTS
# IMPORTS
available_coloring_keywords = Panel(cluster)

# ----
# Explain the Basics of the script application here:
# .
# .
# .
# .
# .
# .
# .
panel_2 = Panel("Snitcher.3dm::**")
data = Data("Snitcher.3dm::**")
data_2 = Data("Snitcher.3dm::**")
data_3 = Data(panel_2)
reflay_r6 = ReferenceByLayerR6(LayerName=data)
reflay_r6_2 = ReferenceByLayerR6(LayerName=data_2)
list = ValueList({"BuildingName", "Type"}, selected="BuildingName")
reflay_r6_3 = ReferenceByLayerR6(LayerName=data_3)
list_2 = ValueList({"Beams", "Building1", "Building2", "Building3", "Columns", "Slab"}, selected="Building3")
list_3 = ValueList({"BuildingName", "Type"}, selected="BuildingName")
list_4 = ValueList({"Beams", "Building1", "Building2", "Building3", "Columns", "Slab"}, selected="Building2")
list_5 = ValueList({"BuildingName", "Type"}, selected="BuildingName")
list_6 = ValueList({"Beams", "Building1", "Building2", "Building3", "Columns", "Slab"}, selected="Building1")
filteratt_r6 = FilterByUserAttributesR6(Attributes=reflay_r6, Key=list, Val=list_2)  # -> G, Key, Val
filteratt_r6_2 = FilterByUserAttributesR6(Attributes=reflay_r6_2, Key=list_3, Val=list_4)  # -> G, Key, Val
filteratt_r6_3 = FilterByUserAttributesR6(Attributes=reflay_r6_3, Key=list_5, Val=list_6)  # -> G, Key, Val
list_7 = ValueList({"BuildingName", "Type"}, selected="Type")
list_8 = ValueList({"BuildingName", "Type"}, selected="Type")
list_9 = ValueList({"BuildingName", "Type"}, selected="Type")
list_10 = ValueList({"BuildingName", "Type"}, selected="Type")
list_11 = ValueList({"Beams", "Columns", "Core", "Slab"}, selected="Columns")
list_12 = ValueList({"BuildingName", "Type"}, selected="Type")
list_13 = ValueList({"Beams", "Columns", "Core", "Slab"}, selected="Slab")
list_14 = ValueList({"BuildingName", "Type"}, selected="Type")
list_15 = ValueList({"Beams", "Columns", "Core", "Slab"}, selected="Core")
list_16 = ValueList({"Beams", "Columns", "Core", "Slab"}, selected="Columns")
list_17 = ValueList({"BuildingName", "Type"}, selected="Type")
list_18 = ValueList({"Beams", "Columns", "Core", "Slab"}, selected="Slab")
list_19 = ValueList({"BuildingName", "Type"}, selected="Type")
list_20 = ValueList({"Beams", "Columns", "Core", "Slab"}, selected="Core")
list_21 = ValueList({"BuildingName", "Type"}, selected="Type")
list_22 = ValueList({"Beams", "Columns", "Core", "Slab"}, selected="Columns")
list_23 = ValueList({"Beams", "Columns", "Core", "Slab"}, selected="Slab")
list_24 = ValueList({"Beams", "Columns", "Core", "Slab"}, selected="Core")
filteratt_r6_4 = FilterByUserAttributesR6(Attributes=filteratt_r6.G, Key=list_8, Val=list_13)  # -> O, Key, Val
filteratt_r6_5 = FilterByUserAttributesR6(Attributes=filteratt_r6.G, Key=list_7, Val=list_11)  # -> O, Key, Val
filteratt_r6_6 = FilterByUserAttributesR6(Attributes=filteratt_r6_2.G, Key=list_12, Val=list_18)  # -> O, Key, Val
filteratt_r6_7 = FilterByUserAttributesR6(Attributes=filteratt_r6.G, Key=list_9, Val=list_15)  # -> O, Key, Val
filteratt_r6_8 = FilterByUserAttributesR6(Attributes=filteratt_r6_2.G, Key=list_10, Val=list_16)  # -> O, Key, Val
filteratt_r6_9 = FilterByUserAttributesR6(Attributes=filteratt_r6_2.G, Key=list_14, Val=list_20)  # -> O, Key, Val
filteratt_r6_10 = FilterByUserAttributesR6(Attributes=filteratt_r6_3.G, Key=list_19, Val=list_23)  # -> O, Key, Val
filteratt_r6_11 = FilterByUserAttributesR6(Attributes=filteratt_r6_3.G, Key=list_17, Val=list_22)  # -> O, Key, Val

# ----
# TEMPLATE AND GOOD PRACTICE TOOLS
# Project #:
# Script Author:  XXX XXX
# Date Created:  XX/XX/2021
toggle_2 = GroupToggle(ToggleActive=True, ToggleVisible=False)  # disabled

filteratt_r6_12 = FilterByUserAttributesR6(Attributes=filteratt_r6_3.G, Key=list_21, Val=list_24)  # -> O, Key, Val
area = Area(Geometry=filteratt_r6_4.O)  # -> Area, Centroid
area_2 = Area(Geometry=filteratt_r6_6.O)  # -> Area, Centroid
midpt = CurveMiddle(Curve=filteratt_r6_5.O)
debrep = DeconstructBrep(Brep=filteratt_r6_7.O)  # -> Faces, Edges, Vertices

# ---- group: Template
# HELP DOCUMENTATION
good_practice_rules = BooleanToggle(False)
template_user_guide = BooleanToggle(False)

# OUTPUTS
# INPUTS
# TEMPLATE
# BASIC GROUP
# LINKS
toggle_3 = GroupToggle(ToggleActive=True, ToggleVisible=False)  # disabled
links_opening = GhPythonScript(y=good_practice_rules, z=template_user_guide)  # -> out, a; inputs y: Boolean, z: Boolean
# ---------- links_opening: Python ----------
__author__ = "AUGC"
__version__ = "2020.08.16"

import rhinoscriptsyntax as rs
import Rhino.Geometry as rg 
import System

GoodP="https://ramboll.sharepoint.com/:b:/r/sites/CODA/Shared%20Documents/General/01_Design_Module_BIM/SIT_GH-Good-Practices.pdf?csf=1&web=1&e=yBAxhZ"
UserG="https://ramboll.sharepoint.com/:b:/r/sites/CODA/Shared%20Documents/General/01_Design_Module_BIM/SIT_GH_Template.pdf?csf=1&web=1&e=8duHDZ"
if y:
    #process.start(GoodP)
    System.Diagnostics.Process.Start(GoodP)
if z:
    System.Diagnostics.Process.Start(UserG)
# ---------- end links_opening ----------

# ----
area_3 = Area(Geometry=filteratt_r6_10.O)  # -> Area, Centroid
midpt_2 = CurveMiddle(Curve=filteratt_r6_8.O)
debrep_2 = DeconstructBrep(Brep=filteratt_r6_9.O)  # -> Faces, Edges, Vertices
sort_pt = SortPoints(Points=area.Centroid)  # -> Points, Indices
midpt_3 = CurveMiddle(Curve=filteratt_r6_11.O)
debrep_3 = DeconstructBrep(Brep=filteratt_r6_12.O)  # -> Faces, Edges, Vertices
sort_pt_2 = SortPoints(Points=area_2.Centroid)  # -> Points, Indices
pdecon = Deconstruct(Point=midpt)  # -> XComponent, YComponent, ZComponent
sort_pt_3 = SortPoints(Points=area_3.Centroid)  # -> Points, Indices
pdecon_2 = Deconstruct(Point=midpt_2)  # -> XComponent, YComponent, ZComponent
item = ListItem(List=filteratt_r6_4.O, Index=sort_pt.Indices, Wrap=True)
attributes = PartAttributes(Name="WALL", Class="2")
item_2 = ListItem(List=filteratt_r6_6.O, Index=sort_pt_2.Indices, Wrap=True)
pdecon_3 = Deconstruct(Point=midpt_3)  # -> XComponent, YComponent, ZComponent
attributes_2 = PartAttributes(Name="WALL", Class="2")
pt = ConstructPoint(XCoordinate=0, YCoordinate=0, ZCoordinate=pdecon.ZComponent)
item_3 = ListItem(List=filteratt_r6_10.O, Index=sort_pt_3.Indices, Wrap=True)
attributes_3 = PartAttributes(Name="WALL", Class="2")
pt_2 = ConstructPoint(XCoordinate=0, YCoordinate=0, ZCoordinate=pdecon_2.ZComponent)
cull_i = CullIndex(List=item, Indices="0", Wrap=True)
attributes_4 = PartAttributes(Name="SLAB", Profile="250")
slab = Slab(
    Boundary=debrep.Faces,
    Attributes=attributes,
    Orient=True,
    Remove_when_input_is_empty=False,
    Remove_while_inputs_are_being_modified=False,
    Run_in_background=True)
pt_3 = ConstructPoint(XCoordinate=0, YCoordinate=0, ZCoordinate=pdecon_3.ZComponent)
cull_i_2 = CullIndex(List=item_2, Indices="0", Wrap=True)
attributes_5 = PartAttributes(Name="SLAB", Profile="250")
pgroups = PointGroups(Points=pt, Distance="0.05")  # -> Groups, Indices
slab_2 = Slab(
    Boundary=debrep_2.Faces,
    Attributes=attributes_2,
    Orient=True,
    Remove_when_input_is_empty=False,
    Remove_while_inputs_are_being_modified=False,
    Run_in_background=True)
cull_i_3 = CullIndex(List=item_3, Indices="0", Wrap=True)
pgroups_2 = PointGroups(Points=pt_2, Distance="0.05")  # -> Groups, Indices
attributes_6 = PartAttributes(Name="SLAB", Profile="250")
slab_3 = Slab(
    Boundary=debrep_3.Faces,
    Attributes=attributes_3,
    Orient=True,
    Remove_when_input_is_empty=False,
    Remove_while_inputs_are_being_modified=False,
    Run_in_background=True)
slab_4 = Slab(
    Boundary=cull_i,
    Attributes=attributes_4,
    Orient=True,
    Remove_when_input_is_empty=False,
    Remove_while_inputs_are_being_modified=False,
    Run_in_background=True)
pgroups_3 = PointGroups(Points=pt_3, Distance="0.05")  # -> Groups, Indices
slab_5 = Slab(
    Boundary=cull_i_2,
    Attributes=attributes_5,
    Orient=True,
    Remove_when_input_is_empty=False,
    Remove_while_inputs_are_being_modified=False,
    Run_in_background=True)

# ---- group: Template
# BIFOCALS CONTROL PANEL
# Double click to see the elements types
# METAHOPPER WIRES SHOW
# Shows all the hidden wires
toggle_4 = BooleanToggle(False)
wiretoggle = WireDisplayToggle(ShowHiddenWires=toggle_4)

# ----
item_4 = ListItem(List=filteratt_r6_5.O, Index=pgroups.Indices, Wrap=True)  # -> simplify(Item)
slab_6 = Slab(
    Boundary=cull_i_3,
    Attributes=attributes_6,
    Orient=True,
    Remove_when_input_is_empty=False,
    Remove_while_inputs_are_being_modified=False,
    Run_in_background=True)
item_5 = ListItem(List=filteratt_r6_8.O, Index=pgroups_2.Indices, Wrap=True)  # -> simplify(Item)
item_6 = ListItem(List=filteratt_r6_11.O, Index=pgroups_3.Indices, Wrap=True)  # -> simplify(Item)
input = PluginInput(Input=graft(slab_4))
tstat = TreeStatistics(Tree=item_4)  # -> Paths, Length, Count
input_2 = PluginInput(Input=graft(slab_5))
C = ComponentCatalog(CNumber=30000018, CType="COMPONENT", UIName="Slab bars (18)")
tstat_2 = TreeStatistics(Tree=item_5)  # -> Paths, Length, Count
input_3 = PluginInput(Input=graft(slab))
C_2 = ComponentCatalog(CNumber=30000018, CType="COMPONENT", UIName="Slab bars (18)")
input_4 = PluginInput(Input=graft(slab_6))
C_3 = ComponentCatalog(CNumber=30000018, CType="COMPONENT", UIName="Slab bars (18)")
input_5 = PluginInput(Input=graft(slab_2))
tstat_3 = TreeStatistics(Tree=item_6)  # -> Paths, Length, Count
C_4 = ComponentCatalog(CNumber=30000018, CType="COMPONENT", UIName="Slab bars (18)")
C_5 = ComponentCatalog(CNumber=30000018, CType="COMPONENT", UIName="Slab bars (18)")
input_6 = PluginInput(Input=graft(slab_3))
C_6 = ComponentCatalog(CNumber=30000018, CType="COMPONENT", UIName="Slab bars (18)")
component = Component(
    Name=C,
    AttributeFile="Test_Snitch",
    PluginInput=input,
    Remove_when_input_is_empty=False,
    Remove_while_inputs_are_being_modified=True,
    Run_in_background=True)
split = SplitList(List=tstat.Paths, Index=Slider(10, range=0..30))  # -> ListA, ListB
component_2 = Component(
    Name=C_2,
    AttributeFile="Test_Snitch",
    PluginInput=input_2,
    Remove_when_input_is_empty=False,
    Remove_while_inputs_are_being_modified=True,
    Run_in_background=True)
split_2 = SplitList(List=tstat_2.Paths, Index=Slider(8, range=0..30))  # -> ListA, ListB
component_3 = Component(
    Name=C_3,
    AttributeFile="Wall_Snitch",
    PluginInput=input_3,
    Remove_when_input_is_empty=False,
    Remove_while_inputs_are_being_modified=True,
    Run_in_background=True)
component_4 = Component(
    Name=C_4,
    AttributeFile="Test_Snitch",
    PluginInput=input_4,
    Remove_when_input_is_empty=False,
    Remove_while_inputs_are_being_modified=True,
    Run_in_background=True)

# ---- group: TEMPLATE
# BEST PRACTIZER
# This creates Inputs and outputs at the edges of a group
# 
# 1) Select group to "best Practise"
# 2) Click on "Select" button
# 3) Click on the "Activate"
activate = Button()
bestpracticizer = BestPracticizer(Activate=activate)

# ----
component_5 = Component(
    Name=C_5,
    AttributeFile="Wall_Snitch",
    PluginInput=input_5,
    Remove_when_input_is_empty=False,
    Remove_while_inputs_are_being_modified=True,
    Run_in_background=True)
split_3 = SplitList(List=tstat_3.Paths, Index=Slider(5, range=0..30))  # -> ListA, ListB
component_6 = Component(
    Name=C_6,
    AttributeFile="Wall_Snitch",
    PluginInput=input_6,
    Remove_when_input_is_empty=False,
    Remove_while_inputs_are_being_modified=True,
    Run_in_background=True)

# ---- group: TEMPLATE
# CHANGE WIRE DISPLAY
# This change the wire display of the selected objects (It affects the wires before the selected object)
# 
# 1) Select the objects
# 2) Click on "Select" button
# 3) Pick the wire type you want to apply
list_25 = ValueList({"Normal": 0, "Faint": 1, "Hidden": 2}, selected="Faint")
# IMPORTS
# INPUTS
# TEMPLATE
wiredisplay = ControlWireDisplay(WireDisplay=list_25)

# ----
branch = TreeBranch(Tree=item_4, Path=split.ListA, MaintainPaths=True)
branch_2 = TreeBranch(Tree=item_4, Path=split.ListB, MaintainPaths=True)
branch_3 = TreeBranch(Tree=item_5, Path=split_2.ListA, MaintainPaths=True)
branch_4 = TreeBranch(Tree=item_5, Path=split_2.ListB, MaintainPaths=True)
branch_5 = TreeBranch(Tree=item_6, Path=split_3.ListA, MaintainPaths=True)
branch_6 = TreeBranch(Tree=item_6, Path=split_3.ListB, MaintainPaths=True)
long = LongestList(ListA=branch, ListB="D700", ListC="Column_Snitch_1", PaddingMode=2)  # -> ListA, ListB, ListC
long_2 = LongestList(ListA=branch_2, ListB="D400", ListC="Column_Snitch_2", PaddingMode=2)  # -> ListA, ListB, ListC
long_3 = LongestList(ListA=branch_3, ListB="D700", ListC="Column_Snitch_1", PaddingMode=2)  # -> ListA, ListB, ListC
long_4 = LongestList(ListA=branch_4, ListB="D400", ListC="Column_Snitch_2", PaddingMode=2)  # -> ListA, ListB, ListC
long_5 = LongestList(ListA=branch_5, ListB="D700", ListC="Column_Snitch_1", PaddingMode=2)  # -> ListA, ListB, ListC
long_6 = LongestList(ListA=branch_6, ListB="D400", ListC="Column_Snitch_2", PaddingMode=2)  # -> ListA, ListB, ListC
merge = Merge(Data1=long.ListC, Data2=long_2.ListB)  # -> flatten(Result)
merge_2 = Merge(Data1=long.ListA, Data2=long_2.ListA)
merge_3 = Merge(Data1=long.ListB, Data2=long_2.ListB)
merge_4 = Merge(Data1=long_3.ListC, Data2=long_4.ListB)  # -> flatten(Result)
merge_5 = Merge(Data1=long_3.ListA, Data2=long_4.ListA)
merge_6 = Merge(Data1=long_3.ListB, Data2=long_4.ListB)
merge_7 = Merge(Data1=long_5.ListC, Data2=long_6.ListB)  # -> flatten(Result)
merge_8 = Merge(Data1=long_5.ListA, Data2=long_6.ListA)
merge_9 = Merge(Data1=long_5.ListB, Data2=long_6.ListB)
attributes_7 = PartAttributes(Name="COLUMN", Profile=merge_3)
attributes_8 = PartAttributes(Name="COLUMN", Profile=merge_6)
attributes_9 = PartAttributes(Name="COLUMN", Profile=merge_9)
column = Column(
    Curve=merge_2,
    Attributes=attributes_7,
    Remove_when_input_is_empty=False,
    Remove_while_inputs_are_being_modified=False,
    Run_in_background=True)
column_2 = Column(
    Curve=merge_5,
    Attributes=attributes_8,
    Remove_when_input_is_empty=False,
    Remove_while_inputs_are_being_modified=False,
    Run_in_background=True)
column_3 = Column(
    Curve=merge_8,
    Attributes=attributes_9,
    Remove_when_input_is_empty=False,
    Remove_while_inputs_are_being_modified=False,
    Run_in_background=True)
input_7 = PluginInput(Input=graft(column))
C_7 = ComponentCatalog(CNumber=30000082, CType="COMPONENT", UIName="Round column reinforcement (82)")
input_8 = PluginInput(Input=graft(column_2))
C_8 = ComponentCatalog(CNumber=30000082, CType="COMPONENT", UIName="Round column reinforcement (82)")
input_9 = PluginInput(Input=graft(column_3))
# GROUPINGS COLORS
# OUTPUTS
# EXPORTS
# EXCEL
C_9 = ComponentCatalog(CNumber=30000082, CType="COMPONENT", UIName="Round column reinforcement (82)")
component_7 = Component(
    Name=C_7,
    AttributeFile=merge,
    PluginInput=input_7,
    Remove_when_input_is_empty=False,
    Remove_while_inputs_are_being_modified=True,
    Run_in_background=True)
component_8 = Component(
    Name=C_8,
    AttributeFile=merge_4,
    PluginInput=input_8,
    Remove_when_input_is_empty=False,
    Remove_while_inputs_are_being_modified=True,
    Run_in_background=True)
# VISUALISATION
# BASIC GROUP
# TEKLA
component_9 = Component(
    Name=C_9,
    AttributeFile=merge_7,
    PluginInput=input_9,
    Remove_when_input_is_empty=False,
    Remove_while_inputs_are_being_modified=True,
    Run_in_background=True)

# ==== cluster Cluster_2
button = Button()
toggle = BooleanToggle(False)
temporary_run_component = ClusterInput()
disable_component = ClusterInput()
all_groups = ClusterInput()
temporary_run_component_2 = Boolean(temporary_run_component)
disable_component_2 = Boolean(disable_component)
all_groups_2 = Data(all_groups)
xor = GateXor(A=disable_component_2, B=temporary_run_component_2)
gate = StreamGate(Stream=all_groups_2, Gate=xor)  # -> Target0, Target1
panel = Panel("AA")  # disabled
objfromgroup = GetObjectsInGroup()  # disabled
objbynn = GetObjectByNickname(NickName=panel)  # disabled
objfromgroup_2 = GetObjectsInGroup(Group=objbynn)  # disabled
txt = Text(["Grasshopper.Kernel.Components.GH_TextTagComponent", "Grasshopper.Kernel.Components.GH_TextTag3DComponent", "DimensionComponents.Component_AlignedDimension", "DimensionComponents.Component_LineDimension", "DimensionComponents.Component_LinearDimension", "DimensionComponents.Component_MarkerDimension", "DimensionComponents.Component_SerialDimension", "DimensionComponents.Component_AngularSimpleDimension", "DimensionComponents.Component_AngularArcDimension", "DimensionComponents.Component_AngularCircleDimension", "MathComponents.ColourComponents.Component_CreateOGLMaterial", "Grasshopper.Kernel.Components.GH_CustomPreviewComponent", "VectorComponents.PointComponents.Component_CloudDisplay", "VectorComponents.PointComponents.Component_DotDisplay", "DimensionComponents.Component_PointListDisplay", "DimensionComponents.Component_PointOrderDisplay", "VectorComponents.VectorComponents.Component_VectorDisplay", "VectorComponents.VectorComponents.Component_VectorDisplay2"])  # disabled
merge = Merge(Data1=txt, Data2=objfromgroup_2)  # -> flatten(Result); disabled

# ---- group: Karamba groups
karamba = Text(["Karamba.GHopper.Licenses.Component_License", "Karamba.GHopper.Models.Component_AssembleModel", "Karamba.GHopper.Models.Component_ConnectedParts", "Karamba.GHopper.Models.Component_DissembleModel", "Karamba.GHopper.Models.Component_ElementActivate", "Karamba.GHopper.Elements.Component_LineToBeam"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])
sofistik = Text(["gh_sofistik.General.GH_Project_Component", "gh_sofistik.General.CreateAnalysisInput", "gh_sofistik.General.GH_ReadSpreadsheet_Component", "gh_sofistik.General.TextStream", "gh_sofistik.Section.CreateAquaInput", "gh_sofistik.Section.GH_ReadSectionCdb_Component", "gh_sofistik.Section.JSON.GH_ReadSectionJSON_Component", "gh_sofistik.Section.GH_SectionFromBrep_Component", "gh_sofistik.Section.GH_CompositeSection_Component", "gh_sofistik.Section.GH_ModifySection_Component", "gh_sofistik.Section.GH_ViewSection_Component", "gh_sofistik.Structure.CreateSofimshcInput", "gh_sofistik.Structure.GH_StructuralArea_Component", "gh_sofistik.Structure.GH_StructuralLine_Component", "gh_sofistik.Structure.GH_StructuralPoint_Component", "gh_sofistik.Structure.GH_BridgeBearing_Component", "gh_sofistik.Structure.GH_ElasticCoupling_Component", "gh_sofistik.Structure.GH_Coupling_Component", "gh_sofistik.Structure.GH_Spring_Component", "gh_sofistik.Load.CreateSofiloadInput", "gh_sofistik.Load.GH_AreaLoad_Component", "gh_sofistik.Load.GH_LineLoad_Component", "gh_sofistik.Load.GH_PointLoad_Component", "gh_sofistik.Geometry.CreateGeometricAxis", "gh_sofistik.AxisModeling.GH_SecondaryAxis_Interpolator_Component", "gh_sofistik.Geometry.GH_ReadGeometricAxisCdb_Component", "gh_sofistik.Geometry.GH_ReadLandXML_Component", "gh_sofistik.Geometry.GH_CurveReparameterize_Component", "gh_sofistik.Geometry.GH_AlignmentAxis_Component", "gh_sofistik.Geometry.GH_AlignmentAxisHorizontal_Component", "gh_sofistik.Geometry.GH_AlignmentAxisVertical_Component", "gh_sofistik.AxisModeling.GH_Axis_Component", "gh_sofistik.AxisModeling.GH_AxisPlacementByParams_Component", "gh_sofistik.AxisModeling.GH_AxisPlacementByPlane_Component", "gh_sofistik.AxisModeling.GH_PlacementTransform_Component", "gh_sofistik.AxisModeling.GH_AxisVariableCustomized_Parameter", "gh_sofistik.AxisModeling.GH_EvaluateVariable_Component", "gh_sofistik.AxisModeling.GH_AxisVariableByExpression_Component", "gh_sofistik.AxisModeling.GH_AxisVariableByPoints_Component", "gh_sofistik.AxisModeling.GH_EvaluateSection_Component", "gh_sofistik.AxisModeling.GH_Curve_Interpolator_Component", "gh_sofistik.AxisModeling.GH_Solid_Interpolator_Component", "gh_sofistik.AxisModeling.GH_Face_Interpolator_Component", "gh_sofistik.Tendon.CreateTendonInput", "gh_sofistik.Tendon.GH_TendonGeometryExternal_Component", "gh_sofistik.Tendon.GH_TendonGeometrySpline_Component", "gh_sofistik.Tendon.GH_TendonGeometryStraight_Component", "gh_sofistik.Tendon.GH_TendonDefinition_Component"])
panel_2 = Panel("""Karamba
Fem
Lusas
Rfem
Sofistik""")
merge_2 = Merge(Data1=karamba, Data2=sofistik)  # -> flatten(Result)
txt_2 = Text(merge_2)
col = Colour(RGBA(225, 0, 26, 150))
data = Data(gate.Target0)
case = TextCase(Text=panel_2, Culture=127)  # -> UpperCase, LowerCase
merge_3 = Merge(Data1=panel_2, Data2=case.UpperCase, Data3=case.LowerCase)
group_names = Text(merge_3)

# ---- group: Ramboll logo and bifocals group
data_2 = Data(gate.Target0)
col_2 = Colour(RGBA(255, 255, 255, 150))
panel_3 = Panel("""Ramboll 
Template""")
selobj = GetSelectedObjects()  # -> ComponentObjects, ParamObjects, OtherObjects
txt_3 = Text(["Bifocals.BifocalsComponent", "Grasshopper.Kernel.Special.GH_Markup"])
sametype = GetObjectsOfSameType(Objects=selobj.ComponentObjects)
samelib = GetObjectsOfSameLibrary(Objects=selobj.ComponentObjects)
case_2 = TextCase(Text=panel_3, Culture=127)  # -> UpperCase, LowerCase
merge_4 = Merge(Data1=txt_3, Data2=samelib, Data3=sametype)
merge_5 = Merge(Data1=panel_3, Data2=case_2.UpperCase, Data3=case_2.LowerCase)
group_names_2 = Text(merge_5)

# ---- group: Tekla groups
col_3 = Colour(RGBA(54, 53, 69, 150))
data_3 = Data(gate.Target0)
txt_4 = Text(["GTLink.Components.CreateSteelBeamComponent", "GTLink.Components.CreateSteelBeam2PtComponent", "GTLink.Components.CreateSteelColumnComponent", "GTLink.Components.CreatePlateComponent", "GTLink.Components.CreateConcreteBeamComponent", "GTLink.Components.CreateConcreteBeam2PtComponent", "GTLink.Components.CreateConcreteColumnComponent", "GTLink.Components.CreatePadFootingComponent", "GTLink.Components.CreatePanelComponent", "GTLink.Components.CreateSlabComponent", "GTLink.Components.CreateStripFootingComponent", "GTLink.Components.CreateSingleRebarComponent", "GTLink.Components.CreateRebarGroupComponent", "GTLink.Components.ExtrudeBeamsComponent", "GTLink.Components.CreateFittingComponent", "GTLink.Components.CreateBooleanPartComponent", "GTLink.Components.CreateCutPlaneComponent", "GTLink.Components.CreateComponentComponent", "GTLink.Components.CreateGridComponent", "GTLink.Components.CreatePointComponent", "GTLink.Components.ComponentCatalogComponent", "GTLink.Components.MaterialCatalogComponent", "GTLink.Components.ProfileCatalogComponent", "GTLink.Components.ReinfocementCatalogComponent", "GTLink.Components.DeformingAttributesComponent", "GTLink.Components.NumberingAttributesComponent", "GTLink.Components.PartAttributesComponent", "GTLink.Components.PositionComponent", "GTLink.Components.CoverAttributesComponent", "GTLink.Components.RebarGroupAttributesComponent", "GTLink.Components.HookAttributesComponent", "GTLink.Components.HooksAttributesComponent", "GTLink.Components.RebarAttributesComponent", "GTLink.Components.ComponentInputComponent", "GTLink.Components.GetBeamComponent", "GTLink.Components.GetComponentComponent", "GTLink.Components.GetItemComponent", "GTLink.Components.GetModelObjectComponent", "GTLink.Components.GetPlateComponent", "GTLink.Components.GetPointComponent", "GTLink.Components.ConvertToBrepComponent", "GTLink.Components.ProfileContour"])
case_3 = TextCase(Text="Tekla", Culture=127)  # -> UpperCase, LowerCase
merge_6 = Merge(Data1="Tekla", Data2=case_3.UpperCase, Data3=case_3.LowerCase)
group_names_3 = Text(merge_6)

# ---- group: Import
import = Text(["IOComponents.Rhino3dmImporter", "IOComponents.PointImporter", "IOComponents.ShapeFileImporter", "IOComponents.PDBFileImporter", "IOComponents.ImageImporter", "Grasshopper.Kernel.Components.GH_ReadFileComponent", "Elefront.Component.Reference.Component_RefBake", "Elefront.Component.Reference.Component_RefColor", "Elefront.Component.Reference.Component_RefLayer", "Elefront.Component.Reference.Component_RefName", "Elefront.Component.Reference.Component_RefType", "Elefront.Component.Reference.Component_RefAtt"])
data_4 = Data(gate.Target0)
col_4 = Colour(RGBA(0, 78, 255, 150))
panel_4 = Panel("""Import
Imports""")
case_4 = TextCase(Text=panel_4, Culture=127)  # -> UpperCase, LowerCase
merge_7 = Merge(Data1=panel_4, Data2=case_4.UpperCase, Data3=case_4.LowerCase)
group_names_4 = Text(merge_7)

# ----
data_5 = Data(gate.Target0)
col_5 = Colour(RGBA(0, 0, 0, 38))
group = Text("Grasshopper.Kernel.Special.GH_Group")
panel_5 = Panel(""".
-""")
group_names_5 = Text(panel_5)

# ---- group: Output groups
data_6 = Data(gate.Target0)
col_6 = Colour(RGBA(137, 255, 255, 150))
panel_6 = Panel("""Output
Outputs""")
case_5 = TextCase(Text=panel_6, Culture=127)  # -> UpperCase, LowerCase
merge_8 = Merge(Data1=panel_6, Data2=case_5.UpperCase, Data3=case_5.LowerCase)
group_names_6 = Text(merge_8)

# ---- group: Input groups
txt_5 = Text(["Grasshopper.Kernel.Special.GH_NumberSlider", "Grasshopper.Kernel.Special.GH_BooleanToggle", "Grasshopper.Kernel.Special.GH_DialKnob", "Grasshopper.Kernel.Special.GH_DigitScroller", "Grasshopper.Kernel.Special.GH_ValueList", "Grasshopper.Kernel.Special.GH_ButtonObject", "Grasshopper.Kernel.Special.GH_MultiDimensionalSlider", "Grasshopper.Kernel.Special.GH_GradientControl", "Grasshopper.Kernel.Special.GH_ImageSampler", "MathComponents.TimeComponents.CalendarObject", "MathComponents.TimeComponents.ClockObject", "Grasshopper.Kernel.Special.GH_ColourPickerObject", "Grasshopper.Kernel.Special.GH_ColourSwatch", "Grasshopper.Kernel.Special.GH_ColourWheel", "Grasshopper.Kernel.Special.GH_GraphMapper", "IOComponents.AtomExtractor", "IOComponents.Rhino3dmImporter", "IOComponents.PointImporter", "IOComponents.ImageImporter", "IOComponents.PDBFileImporter", "IOComponents.ShapeFileImporter", "IOComponents.ReferencedObjectDetailsComponent", "Grasshopper.Kernel.Components.GH_ReadFileComponent"])
col_7 = Colour(RGBA(0, 0, 255, 150))
data_7 = Data(gate.Target0)
panel_7 = Panel("""Inputs
Input""")
panel_8 = Panel("""Inputs
Input
INPUT
INPUTS
input
inputs""")
case_6 = TextCase(Text=panel_7, Culture=127)  # -> UpperCase, LowerCase
merge_9 = Merge(Data1=panel_7, Data2=case_6.UpperCase, Data3=case_6.LowerCase)
group_names_7 = Text(merge_9)

# ---- group: Export
data_8 = Data(gate.Target0)
col_8 = Colour(RGBA(118, 0, 255, 150))
export = Text(["LunchBox.WF_Bake", "LunchBox.WF_Save", "Elefront.Component.Attributes.BakeAtt", "Elefront.Component.Attributes.Component_BakeLayer"])
panel_9 = Panel("""Export
Exports""")
case_7 = TextCase(Text=panel_9, Culture=127)  # -> UpperCase, LowerCase
merge_10 = Merge(Data1=panel_9, Data2=case_7.UpperCase, Data3=case_7.LowerCase)
group_names_8 = Text(merge_10)

# ---- group: Custom preview groups
col_9 = Colour(RGBA(255, 0, 255, 150))
data_9 = Data(gate.Target0)
txt_6 = Text(["Grasshopper.Kernel.Components.GH_TextTagComponent", "Grasshopper.Kernel.Components.GH_TextTag3DComponent", "DimensionComponents.Component_AlignedDimension", "DimensionComponents.Component_LineDimension", "DimensionComponents.Component_LinearDimension", "DimensionComponents.Component_MarkerDimension", "DimensionComponents.Component_SerialDimension", "DimensionComponents.Component_AngularSimpleDimension", "DimensionComponents.Component_AngularArcDimension", "DimensionComponents.Component_AngularCircleDimension", "MathComponents.ColourComponents.Component_CreateOGLMaterial", "Grasshopper.Kernel.Components.GH_CustomPreviewComponent", "VectorComponents.PointComponents.Component_CloudDisplay", "VectorComponents.PointComponents.Component_DotDisplay", "DimensionComponents.Component_PointListDisplay", "DimensionComponents.Component_PointOrderDisplay", "VectorComponents.VectorComponents.Component_VectorDisplay", "VectorComponents.VectorComponents.Component_VectorDisplay2", "Human.CustomPreviewLineWeights", "Human.CurveToScreen", "Human.PointToScreen", "Human.ScreenOrientedMesh", "Human.ScreenToWorldTag", "Human.CustomPreviewMaterials", "Human.MeshToScreen", "Human.TextToScreen", "Human.ScreenOrientedText"])
panel_10 = Panel("""Preview
Visualisation
Visualization""")
case_8 = TextCase(Text=panel_10, Culture=127)  # -> UpperCase, LowerCase
merge_11 = Merge(Data1=panel_10, Data2=case_8.UpperCase, Data3=case_8.LowerCase)
group_names_9 = Text(merge_11)

# ---- group: Excel groups
data_10 = Data(gate.Target0)
txt_7 = Text(["CORE.Grasshopper.Toolbox.readExcelSheet", "CORE.Grasshopper.Toolbox.writeToExcel", "CORE.Grasshopper.Toolbox.WriteOptions"])
col_10 = Colour(RGBA(33, 115, 70, 150))
case_9 = TextCase(Text="Excel", Culture=127)  # -> UpperCase, LowerCase
merge_12 = Merge(Data1="Excel", Data2=case_9.UpperCase, Data3=case_9.LowerCase)
group_names_10 = Text(merge_12)

# ----
entwine = Entwine(
    Branch00=group_names,
    Branch01=group_names_3,
    Branch02=group_names_10,
    Branch03=group_names_9,
    Branch04=group_names_2,
    Branch05=group_names_7,
    Branch06=group_names_6,
    Branch07=group_names_5,
    Branch08=group_names_8,
    Branch09=group_names_4,
    FlattenInputs=True)
R = ClusterOutput(entwine)
all_group_names = Text(flatten(entwine))

# ---- group: Karamba groups (continued)
all_group_names_2 = Text(all_group_names)
cluster = Cluster(
    all_groups=data,
    objects=txt_2,
    colour=col,
    group_names=merge_3,
    all_group_names=all_group_names_2,
    color_groups_of_groups=Toggle(True))  # -> groups_2, already_colored
txt_8 = Text(cluster.groups_2)

# ----
group_coloring_rules = Boolean(cluster.already_colored)

# ---- group: Tekla groups (continued)
group_coloring_rules_2 = Boolean(group_coloring_rules)
all_group_names_3 = Text(all_group_names)
cluster_2 = Cluster(
    all_groups=data_3,
    objects=txt_4,
    colour=col_3,
    group_names=merge_6,
    all_group_names=all_group_names_3,
    other_groups_coloring_rules=group_coloring_rules_2,
    color_groups_of_groups=Toggle(True))  # -> groups_2, already_colored
group_coloring_rules_3 = Boolean(cluster_2.already_colored)
txt_9 = Text(cluster_2.groups_2)

# ---- group: Excel groups (continued)
group_coloring_rules_4 = Boolean(group_coloring_rules_3)
all_group_names_4 = Text(all_group_names)
cluster_3 = Cluster(
    all_groups=data_10,
    objects=txt_7,
    colour=col_10,
    group_names=merge_12,
    all_group_names=all_group_names_4,
    other_groups_coloring_rules=group_coloring_rules_4,
    color_groups_of_groups=Toggle(True))  # -> groups_2, already_colored
group_coloring_rules_5 = Boolean(cluster_3.already_colored)
txt_10 = Text(cluster_3.groups_2)

# ---- group: Custom preview groups (continued)
group_coloring_rules_6 = Boolean(group_coloring_rules_5)
all_group_names_5 = Text(all_group_names)
cluster_4 = Cluster(
    all_groups=data_9,
    objects=txt_6,
    colour=col_9,
    group_names=merge_11,
    all_group_names=all_group_names_5,
    other_groups_coloring_rules=group_coloring_rules_6)  # -> groups_2, already_colored
txt_11 = Text(cluster_4.groups_2)
group_coloring_rules_7 = Boolean(cluster_4.already_colored)

# ---- group: Export (continued)
group_coloring_rules_8 = Boolean(group_coloring_rules_7)
all_group_names_6 = Text(all_group_names)
cluster_5 = Cluster(
    all_groups=data_8,
    objects=export,
    colour=col_8,
    group_names=merge_10,
    all_group_names=all_group_names_6,
    other_groups_coloring_rules=group_coloring_rules_8)  # -> groups_2, already_colored
group_coloring_rules_9 = Boolean(cluster_5.already_colored)
txt_12 = Text(cluster_5.groups_2)

# ---- group: Import (continued)
group_coloring_rules_10 = Boolean(group_coloring_rules_9)
all_group_names_7 = Text(all_group_names)
cluster_6 = Cluster(
    all_groups=data_4,
    objects=import,
    colour=col_4,
    group_names=merge_7,
    all_group_names=all_group_names_7,
    other_groups_coloring_rules=group_coloring_rules_10)  # -> groups_2, already_colored
group_coloring_rules_11 = Boolean(cluster_6.already_colored)
txt_13 = Text(cluster_6.groups_2)

# ---- group: Output groups (continued)
group_coloring_rules_12 = Boolean(group_coloring_rules_11)
all_group_names_8 = Text(all_group_names)
cluster_7 = Cluster(
    all_groups=data_6,
    colour=col_6,
    group_names=merge_8,
    all_group_names=all_group_names_8,
    other_groups_coloring_rules=group_coloring_rules_12)  # -> groups_2, already_colored
group_coloring_rules_13 = Boolean(cluster_7.already_colored)
txt_14 = Text(cluster_7.groups_2)

# ----
group_coloring_rules_14 = Boolean(group_coloring_rules_13)
all_group_names_9 = Text(all_group_names)
cluster_8 = Cluster(
    all_groups=data_5,
    colour=col_5,
    group_names=panel_5,
    all_group_names=all_group_names_9,
    other_groups_coloring_rules=group_coloring_rules_14)  # -> groups_2, already_colored
group_coloring_rules_15 = Boolean(cluster_8.already_colored)
txt_15 = Text(cluster_8.groups_2)

# ---- group: Input groups (continued)
group_coloring_rules_16 = Boolean(group_coloring_rules_15)
all_group_names_10 = Text(all_group_names)
cluster_9 = Cluster(
    all_groups=data_7,
    objects=txt_5,
    colour=col_7,
    group_names=merge_9,
    all_group_names=all_group_names_10,
    other_groups_coloring_rules=group_coloring_rules_16)  # -> groups_2, already_colored
group_coloring_rules_17 = Boolean(cluster_9.already_colored)
txt_16 = Text(cluster_9.groups_2)

# ---- group: Ramboll logo and bifocals group (continued)
group_coloring_rules_18 = Boolean(group_coloring_rules_17)
all_group_names_11 = Text(all_group_names)
cluster_10 = Cluster(
    all_groups=data_2,
    objects=merge_4,
    colour=col_2,
    group_names=merge_5,
    all_group_names=all_group_names_11,
    other_groups_coloring_rules=group_coloring_rules_18)  # -> groups_2, already_colored
group_coloring_rules_19 = Boolean(cluster_10.already_colored)
txt_17 = Text(cluster_10.groups_2)

# ---- group: Other groups
data_11 = Data(gate.Target0)
col_11 = Colour(RGBA(0, 0, 0, 38))
merge_13 = Merge(
    Data1=txt_8,
    Data2=txt_9,
    Data3=txt_10,
    Data4=txt_11,
    Data5=txt_17,
    Data7=txt_16,
    Data8=txt_14,
    Data9=txt_15,
    Data10=txt_12,
    Data11=txt_13)
tstat = TreeStatistics(Tree=merge_13)  # -> Paths, Length, Count
split = SplitTree(Data=simplify(graft(data_11)), Masks=flatten(tstat.Paths))  # -> Positive, Negative
setgroup = SetGroupProperties(Group=split.Negative, Color=col_11)

# ==== cluster Cluster
color_groups_of_groups = ClusterInput()  # Color Groups of groups?

other_groups_coloring_rules = ClusterInput()  # Other groups coloring rules
all_group_names = ClusterInput()  # All Group names
all_groups = ClusterInput()
group_names = ClusterInput()
objects = ClusterInput()
colour = ClusterInput()

bool = Boolean(color_groups_of_groups)
all_group_names_2 = Text(all_group_names)
group_names_2 = Text(group_names)
all_groups_2 = Data(all_groups)
bool_2 = Boolean(other_groups_coloring_rules)
objects_2 = Text(objects)
colour_2 = Colour(colour)

bool_3 = Boolean(bool)
null = NullItem(Item=bool_3)  # -> NullFlags, InvalidFlags, Description
filter = StreamFilter(Gate=null.InvalidFlags, Stream0=bool_3, Stream1=Toggle(False))
color_groups_of_groups_2 = Boolean(filter)

# ----
# Dos the groups has a name from the name list?
group_names_3 = Text(group_names_2)
all_groups_3 = Data(all_groups_2)
all_group_names_3 = Text(all_group_names_2)
object_info = ObjectInfo(Objects=all_groups_3)  # -> Name, NickName, Type, Pivot, Bounds, Value, Enabled, Preview
eval = Evaluate(F="Contains(x, y)", x=graft(object_info.NickName), y=all_group_names_3)
eval_2 = Evaluate(F="Contains(x, y)", x=graft(object_info.NickName), y=group_names_3)
ma = MassAddition(Input=eval_2)  # -> Result, PartialResults
ma_2 = MassAddition(Input=eval)  # -> Result, PartialResults
len = TextLength(Text=object_info.NickName)
group_has_matching_name = Boolean(simplify(ma.Result))
group_has_matching_all_name = Boolean(simplify(ma_2.Result))
group_has_name = Boolean(simplify(graft(len)))

# ----
# Does the group has objects from the object list?
all_groups_4 = Data(all_groups_2)
objects_3 = Text(objects)
objfromgroup = GetObjectsInGroup(Group=all_groups_4)  # -> simplify(Objects)
txt = Text(objfromgroup)
intersection = SetIntersection(SetA=txt, SetB=objects_3)
lng = ListLength(List=intersection)
group_has_object_bool = Boolean(lng)

objects_4 = Text(objects_2)
null_2 = NullItem(Item=objects_4)  # -> NullFlags, InvalidFlags, Description
ma_3 = MassAddition(Input=null_2.InvalidFlags)  # -> Result, PartialResults
bool_4 = Boolean(simplify(ma_3.Result))

# ----
# Does the group contains other groups?
all_groups_5 = Data(all_groups_2)
objfromgroup_2 = GetObjectsInGroup(Group=all_groups_5)  # -> simplify(Objects)
object_info_2 = ObjectInfo(Objects=objfromgroup_2)  # -> Name, NickName, Type, Pivot, Bounds, Value, Enabled, Preview
txt_2 = Text(flatten(object_info_2.Name))
# Changes colour of the group that includes the input objects.
panel = Panel(txt_2)
expression = Expression(x=panel, y="Group", Expression="Contains(x,y)")
unflatten = UnflattenTree(Tree=expression, Guide=object_info_2.Name)
ma_4 = MassAddition(Input=unflatten)  # -> Result, PartialResults
larger = LargerThan(FirstNumber=ma_4.Result, SecondNumber="0")  # -> LargerThan, OrEqualTo
other_groups_contained = Boolean(larger.LargerThan)

other_groups_contained_2 = Boolean(other_groups_contained)
color_the_group = Boolean(group_has_object_bool)
color_groups_of_groups_3 = Boolean(color_groups_of_groups_2)
python = GhPythonScript(x=color_the_group, y=other_groups_contained_2)  # -> out, a; inputs x: Boolean, y: Boolean
# ---------- python: Python ----------
__author__ = "AUGC"
__version__ = "2020.08.16"

import rhinoscriptsyntax as rs
import Rhino.Geometry as rg 
if x and not y: 
    a= 1
else :
    a= 0
# ---------- end python ----------
bool_5 = Boolean(python.a)
filter_2 = StreamFilter(Gate=color_groups_of_groups_3, Stream0=bool_5, Stream1=color_the_group)
color_the_group_2 = Boolean(filter_2)

# ----
# Give priority to the naming (If the group has a Name from the
# All name list, the objects it contains are ignored)
toggle = BooleanToggle(False)
group_has_matching_name_2 = Boolean(simplify(group_has_matching_name))
group_has_matching_all_name_2 = Boolean(simplify(group_has_matching_all_name))
group_has_object_bool_2 = Boolean(simplify(color_the_group_2))
long = LongestList(ListA=group_has_object_bool_2, ListB=toggle, PaddingMode=2)  # -> ListA, ListB
p_n_c = PickNChoose(Pattern=group_has_matching_all_name_2, Stream0=group_has_object_bool_2, Stream1=long.ListB)
or = GateOr(A=p_n_c, B=group_has_matching_name_2)
bool_6 = Boolean(simplify(bool_4))
filter_3 = StreamFilter(Gate=bool_6, Stream0=or, Stream1=group_has_matching_name_2)
color_the_group_3 = Boolean(filter_3)

# ----
# Has the groups already been colored by a color of higher priority
bool_7 = Boolean(bool_2)
bool_8 = Boolean(color_the_group_3)
null_3 = NullItem(Item=bool_7)  # -> NullFlags, flatten(InvalidFlags), Description
long_2 = LongestList(ListA=bool_8, ListB=Toggle(False), PaddingMode=2)  # -> ListA, ListB
item = ListItem(List=null_3.InvalidFlags, Index=0, Wrap=True)
filter_4 = StreamFilter(Gate=item, Stream0=bool_7, Stream1=long_2.ListB)

# ----
# Color the group?
# + update list of colored groups
bool_9 = Boolean(filter_4)
bool_10 = Boolean(color_the_group_3)
expression_2 = Expression(x=bool_9, y=bool_10, Expression="if(x=TRUE,FALSE,y)")
or_2 = GateOr(A=bool_10, B=bool_9)

bool_11 = Boolean(expression_2)
dispatch = Dispatch(List=simplify(graft(all_groups_2)), DispatchPattern=bool_11)  # -> ListA, ListB
clean = CleanTree(RemoveNulls=True, RemoveInvalid=True, RemoveEmpty=True, Tree=dispatch.ListA)
object_info_3 = ObjectInfo(Objects=clean)  # -> Name, NickName, Type, Pivot, Bounds, Value, Enabled, Preview
setgroup = SetGroupProperties(Group=clean, Color=colour_2)
groups = Text(object_info_3.Type)
bool_12 = Boolean(or_2)
groups_2 = ClusterOutput(groups)
already_colored = ClusterOutput(bool_12)  # Already Colored ?
