# Grasshopper definition Results Visualisation.gh (Grasshopper 1.0.7)
# plug-ins: MetaHopper, Bifocals, eleFront Rhino 6 Legacy, Human, Human UI

# ---- group: Template
# Groups color control
# GROUPS HIERARCHY
# FEM
# TEKLA
# EXCEL
toggle = GroupToggle(ToggleActive=True, ToggleVisible=False)  # disabled

# Plug-in dependency
# List necessary plug-ins to run the script
# List the plugins used that are not part of the Ramboll Packages
# you can run the command _GrasshopperPluginList in Rhino
docinfo = DocumentInfo(AutoUpdate=False, Recursive=False)  # -> DocumentName, DocumentFilePath, Components, Params, _3rdPartyAssemblies
# <SCRIPT TITLE>
panel = Panel(docinfo._3rdPartyAssemblies)

# If applicable, input the related softwares linked to that definition
fem_software_and_version = Panel("SOFiSTiK 2020")
tekla_version_used = Panel("""TS2020
GrasshopperTeklaLink_2020.1.8.1""")

temporary_run_component = Button()
disable_component = BooleanToggle(False)

groups = GetGroups()  # -> Groups, GroupStyles, Nickname, Color
cluster = Cluster_2(all_groups=groups.Groups, disable_component=disable_component, temporary_run_component=temporary_run_component)
# VISUALISATION
# EXPORTS
# IMPORTS
available_coloring_keywords = Panel(cluster)

# ----
# Script Description
# Explain the Basics of the script application here:
# .
# .
# .
# .
# .
# .
# .
panel_2 = Panel("Snitcher.3dm::**")
data = Data(panel_2)
reflay_r6 = ReferenceByLayerR6(LayerName=data)
list = ValueList({"BuildingName", "Type"}, selected="BuildingName")
list_2 = ValueList({"Beams", "Building1", "Building2", "Building3", "Columns", "Slab"}, selected="Building3")
filteratt_r6 = FilterByUserAttributesR6(Attributes=reflay_r6, Key=list, Val=list_2)  # -> G, Key, Val
list_3 = ValueList({"BuildingName", "Type"}, selected="Type")
list_4 = ValueList({"BuildingName", "Type"}, selected="Type")
list_5 = ValueList({"Beams", "Columns", "Core", "Slab"}, selected="Slab")
list_6 = ValueList({"BuildingName", "Type"}, selected="Type")
list_7 = ValueList({"Beams", "Columns", "Core", "Slab"}, selected="Columns")
list_8 = ValueList({"Beams", "Columns", "Core", "Slab"}, selected="Core")
filteratt_r6_2 = FilterByUserAttributesR6(Attributes=filteratt_r6.G, Key=list_3, Val=list_5)  # -> O, Key, Val

# ----
# TEMPLATE AND GOOD PRACTICE TOOLS
# Project #:
# Script Author:  XXX XXX
# Date Created:  XX/XX/2021
toggle_2 = GroupToggle(ToggleActive=True, ToggleVisible=False)  # disabled

filteratt_r6_3 = FilterByUserAttributesR6(Attributes=filteratt_r6.G, Key=list_4, Val=list_7)  # -> O, Key, Val
filteratt_r6_4 = FilterByUserAttributesR6(Attributes=filteratt_r6.G, Key=list_6, Val=list_8)  # -> O, Key, Val

# ---- group: Template
# HELP DOCUMENTATION
good_practice_rules = BooleanToggle(False)
template_user_guide = BooleanToggle(False)

# OUTPUTS
# INPUTS
# TEMPLATE
# BASIC GROUP
# LINKS
toggle_3 = GroupToggle(ToggleActive=True, ToggleVisible=False)  # disabled
links_opening = GhPythonScript(y=good_practice_rules, z=template_user_guide)  # -> out, a; inputs y: Boolean, z: Boolean
# ---------- links_opening: Python ----------
__author__ = "AUGC"
__version__ = "2020.08.16"

import rhinoscriptsyntax as rs
import Rhino.Geometry as rg 
import System

GoodP="https://ramboll.sharepoint.com/:b:/r/sites/CODA/Shared%20Documents/General/01_Design_Module_BIM/SIT_GH-Good-Practices.pdf?csf=1&web=1&e=yBAxhZ"
UserG="https://ramboll.sharepoint.com/:b:/r/sites/CODA/Shared%20Documents/General/01_Design_Module_BIM/SIT_GH_Template.pdf?csf=1&web=1&e=8duHDZ"
if y:
    #process.start(GoodP)
    System.Diagnostics.Process.Start(GoodP)
if z:
    System.Diagnostics.Process.Start(UserG)
# ---------- end links_opening ----------

# ----
data_2 = Data(filteratt_r6_2.O)
crv = Curve(filteratt_r6_3.O)
data_3 = Data(filteratt_r6_4.O)

# ---- group: Template
# BIFOCALS CONTROL PANEL
# Double click to see the elements types
# METAHOPPER WIRES SHOW
# Shows all the hidden wires
toggle_4 = BooleanToggle(False)
wiretoggle = WireDisplayToggle(ShowHiddenWires=toggle_4)

# ---- group: TEMPLATE
# BEST PRACTIZER
# This creates Inputs and outputs at the edges of a group
# 
# 1) Select group to "best Practise"
# 2) Click on "Select" button
# 3) Click on the "Activate"
activate = Button()
bestpracticizer = BestPracticizer(Activate=activate)

# ----
data_4 = Data(data_3)
debrep = DeconstructBrep(Brep=data_4)  # -> flatten(Faces), Edges, Vertices
lng = ListLength(List=debrep.Faces)
crv_2 = Curve(debrep.Edges)
random = Random(Range="0 to 100", Number=lng, Seed=2)  # -> simplify(Random)
remap = RemapNumbers(Value=random, Source="0 to 100", Target="0 to 1")  # -> Mapped, Clipped
remap_2 = RemapNumbers(Value=random, Source="0 to 100", Target="1 to 0.5")  # -> Mapped, Clipped
bnd = Bounds(Numbers=remap.Mapped)
dedomain = DeconstructDomain(Domain=bnd)  # -> Start, End
gradient = Gradient(
    LowerLimit=dedomain.Start,
    UpperLimit=dedomain.End,
    Parameter=remap.Mapped,
    stops=[0: RGB(0, 128, 0), 0.5: RGB(255, 255, 0), 1: RGB(255, 0, 0)])
mesh = Mesh(debrep.Faces)
col = Colour(gradient)
mcol = MeshColours(Mesh=graft(mesh), Colours=graft(col))  # -> simplify(flatten(Mesh))
display_mesh = Mesh(mesh)
display_color = Colour(col)
grade = Data(random)

# ---- group: TEMPLATE
# CHANGE WIRE DISPLAY
# This change the wire display of the selected objects (It affects the wires before the selected object)
# 
# 1) Select the objects
# 2) Click on "Select" button
# 3) Pick the wire type you want to apply
list_9 = ValueList({"Normal": 0, "Faint": 1, "Hidden": 2}, selected="Faint")
# IMPORTS
# INPUTS
# TEMPLATE
wiredisplay = ControlWireDisplay(WireDisplay=list_9)

# ----
data_5 = Data(data_2)
lng_2 = ListLength(List=data_5)
crv_3 = Curve(data_5)
pt = Point(Point(0, 0, 0.25))
random_2 = Random(Range="0 to 100", Number=lng_2, Seed=2)  # -> simplify(Random)
boundary = BoundarySurfaces(Edges=data_5)
Z = UnitZ(Factor=pt)
extr = Extrude(Base=boundary, Direction=Z)
remap_3 = RemapNumbers(Value=random_2, Source="0 to 100", Target="0 to 1")  # -> Mapped, Clipped
remap_4 = RemapNumbers(Value=random_2, Source="0 to 100", Target="1 to 0.5")  # -> Mapped, Clipped
bnd_2 = Bounds(Numbers=remap_3.Mapped)
dedomain_2 = DeconstructDomain(Domain=bnd_2)  # -> Start, End
gradient_2 = Gradient(
    LowerLimit=dedomain_2.Start,
    UpperLimit=dedomain_2.End,
    Parameter=remap_3.Mapped,
    stops=[0: RGB(0, 128, 0), 0.5: RGB(255, 255, 0), 1: RGB(255, 0, 0)])
mesh_2 = Mesh(extr)
col_2 = Colour(gradient_2)
mcol_2 = MeshColours(Mesh=graft(mesh_2), Colours=graft(col_2))  # -> simplify(flatten(Mesh))
display_mesh_2 = Mesh(mesh_2)
display_color_2 = Colour(col_2)
grade_2 = Data(random_2)

lng_3 = ListLength(List=filteratt_r6_3.O)
crv_4 = Curve(crv)
random_3 = Random(Range="0 to 100", Number=lng_3, Seed=2)  # -> simplify(Random)
remap_5 = RemapNumbers(Value=random_3, Source="0 to 100", Target="0 to 1")  # -> Mapped, Clipped
remap_6 = RemapNumbers(Value=random_3, Source="0 to 100", Target="1 to 0.5")  # -> Mapped, Clipped
# GROUPINGS COLORS
# OUTPUTS
# EXPORTS
pipe = Pipe(Curve=crv_4, Radius=Slider(0.35, range=0..1), Caps=0)  # -> flatten(Pipe)
bnd_3 = Bounds(Numbers=remap_5.Mapped)
dedomain_3 = DeconstructDomain(Domain=bnd_3)  # -> Start, End
gradient_3 = Gradient(
    LowerLimit=dedomain_3.Start,
    UpperLimit=dedomain_3.End,
    Parameter=remap_5.Mapped,
    stops=[0: RGB(0, 128, 0), 0.5: RGB(255, 255, 0), 1: RGB(255, 0, 0)])
# VISUALISATION
mesh_3 = Mesh(pipe)
col_3 = Colour(gradient_3)
# TEKLA
mcol_3 = MeshColours(Mesh=graft(mesh_3), Colours=graft(col_3))  # -> simplify(flatten(Mesh))
display_mesh_3 = Mesh(mesh_3)
display_color_3 = Colour(col_3)
grade_3 = Data(random_3)

# ----
# EXCEL
previewlw = CustomPreviewLineweights(Geometry=crv_4, Shader=ColourSwatch(SwatchColor=RGB(0, 0, 0)), Thickness="1", Absolute=False)

previewlw_2 = CustomPreviewLineweights(Geometry=crv_3, Shader=ColourSwatch(SwatchColor=RGB(0, 0, 0)), Thickness="1", Absolute=False)
preview = CustomPreview(Geometry=boundary, Material=ColourSwatch(SwatchColor=RGBA(102, 102, 102, 0)))

previewlw_3 = CustomPreviewLineweights(Geometry=crv_2, Shader=ColourSwatch(SwatchColor=RGB(0, 0, 0)), Thickness="1.5", Absolute=False)

panel_3 = Panel("C:\Users\AUGC\source\repos\Snitcher\SnitchGrasshopper\Resources\DogSniffingImage.png")
panel_4 = Panel("""Snitch is an AI powered tool that will help you spot 
crappy design""")
panel_5 = Panel("""0
25
50
75
100""")
consec = ConsecutiveDomains(Numbers=panel_5, Additive=False)
display_worst_cases = Slider(100, range=0..100)
tag_worst_cases = Slider(5, range=0..100)
image = CreateImage(ImageSource=panel_3, ImageWidth="500")
label = CreateLabel(LabelText=panel_4, LabelSize=18, Justification=0)
panel_6 = Panel("""GOOD
SO SO 
NOT SO GOOD
DOG POOP""")
panel_7 = Panel("The grades ave been generated with a database of CO2 optimised projects")
merge = Merge(Data1=label, Data2=image)
expander = CreateExpander(UIElements=merge, Header="WHAT IS SNITCH?", Open=False)
panel_8 = Panel("""All
Columns
Slab
Core""")
slider = CreateSlider(
    Slider=display_worst_cases,
    SnapValue="10",
    ShowBounds=True,
    ShowTicks=False,
    ShowTooltip=False,
    ShowValLabel=True,
    showLabel=True)
slider_2 = CreateSlider(
    Slider=tag_worst_cases,
    SnapValue="5",
    ShowBounds=True,
    ShowTicks=False,
    ShowTooltip=False,
    ShowValLabel=True,
    showLabel=True)
label_2 = CreateLabel(LabelText="YOU HAVE BEEN SNITCHED", LabelSize=18, Justification=1)  # disabled
separator = CreateSeparator(Thickness=0.5, Horizontal=True, Color=RGB(0, 0, 0))
listbox = CreateListBox(ListItems=panel_8, SelectedIndex=0, Height=100)
separator_2 = CreateSeparator(Thickness=0.5, Horizontal=True, Color=RGB(0, 0, 0))
label_3 = CreateLabel(LabelText="WANNA SNITCH?", LabelSize=24, Justification=1)
launchwin = LaunchWindow(Show=Toggle(True), Name="SNITCH", Width="600", Height="900", ChildStatus=2, EnableHorizScroll=False)
label_4 = CreateLabel(LabelText="Display settings", LabelSize=18, Justification=1)
separator_3 = CreateSeparator(Thickness=0.5, Horizontal=True, Color=RGB(0, 0, 0))
values = ValueListener(Elements=slider, SomeProperty=True)  # -> Values, Indices
values_2 = ValueListener(Elements=slider_2, SomeProperty=True)  # -> Values, Indices
values_3 = ValueListener(Elements=listbox, SomeProperty=True)  # -> Values, Indices
merge_2 = Merge(
    Data1=ColourSwatch(SwatchColor=RGB(75, 214, 0)),
    Data2=ColourSwatch(SwatchColor=RGB(247, 255, 0)),
    Data3=ColourSwatch(SwatchColor=RGB(255, 119, 0)),
    Data4=ColourSwatch(SwatchColor=RGB(255, 0, 0)))
display_value = Data(values_3.Values)
# BASIC GROUP
display_value_2 = Data(display_value)
python = GhPythonScript(x=display_value_2)  # -> out, a
# ---------- python: Python ----------
__author__ = "AUGC"
__version__ = "2023.04.15"

import rhinoscriptsyntax as rs
print(x)
if x == "Columns": 
    a=0
elif x == "Slab": 
    a=1
elif x == "Core": 
    a=2
elif x == "All": 
    a=3
print(a)
# ---------- end python ----------
filter = StreamFilter(
    Gate=python.a,
    Stream0=display_mesh_3,
    Stream1=display_mesh_2,
    Stream2=display_mesh,
    Stream3=[display_mesh_3, display_mesh_2, display_mesh])  # -> flatten(Stream)
filter_2 = StreamFilter(
    Gate=python.a,
    Stream0=display_color_3,
    Stream1=display_color_2,
    Stream2=display_color,
    Stream3=[display_color_3, display_color_2, display_color])  # -> flatten(Stream)
filter_3 = StreamFilter(Gate=python.a, Stream0=grade_3, Stream1=grade_2, Stream2=grade, Stream3=flatten([grade_3, grade_2, grade]))
display_color_4 = Colour(filter_2)
display_mesh_4 = Mesh(filter)
grade_4 = Data(filter_3)
display_mesh_5 = Mesh(display_mesh_4)
display_color_5 = Colour(display_color_4)
grade_5 = Data(grade_4)
# Total CO2 per element type
fdom = FindDomain(Domains=consec, Number=grade_5, Strict=False)  # -> Index, Neighbour
display_mesh_6 = Mesh(display_mesh_5)
display_color_6 = Colour(display_color_5)
grade_6 = Data(grade_5)
pt_2 = ConstructPoint(XCoordinate=fdom.Index, YCoordinate=0, ZCoordinate=0)
display_mesh_7 = Mesh(display_mesh_5)
display_color_7 = Colour(display_color_5)
grade_7 = Data(grade_5)
sort = SortList(Keys=grade_6, ValuesA=display_mesh_6, ValuesB=display_color_6)  # -> reverse(Keys), reverse(ValuesA), reverse(ValuesB)
pgroups = PointGroups(Points=pt_2, Distance="0.01")  # -> simplify(Groups), simplify(Indices)
sort_2 = SortList(Keys=grade_7, ValuesA=display_mesh_7, ValuesB=display_color_7)  # -> reverse(Keys), reverse(ValuesA), reverse(ValuesB)
lng_4 = ListLength(List=pgroups.Indices)  # -> reverse(flatten(Length))
lng_5 = ListLength(List=sort.Keys)
expression = Expression(x=lng_5, y=values.Values, Expression="x*y/100")
lng_6 = ListLength(List=sort_2.Keys)
display_value_3 = Data(display_value)
display_value_4 = Data(display_value)
expression_2 = Expression(x=lng_6, y=values_2.Values, Expression="x*y/100")
panel_9 = Panel(lng_4)
split = SplitList(List=sort.Keys, Index=expression)  # -> ListA, ListB
concat = Concatenate(FragmentA=display_value_3, FragmentB=" CO2 emissions: ", FragmentC="XXt (CO2eq)")
split_2 = SplitList(List=sort.ValuesB, Index=expression)  # -> ListA, ListB
split_3 = SplitList(List=sort.ValuesA, Index=expression)  # -> ListA, ListB
concat_2 = Concatenate(FragmentA=display_value_4, FragmentB=" emissions Savings: ", FragmentC="XXt (CO2eq)")
split_4 = SplitList(List=sort_2.Keys, Index=expression_2)  # -> ListA, ListB
demesh = DeconstructMesh(Mesh=split_3.ListA)  # -> simplify(Vertices), Faces, Colours, Normals
split_5 = SplitList(List=sort_2.ValuesB, Index=expression_2)  # -> ListA, ListB
split_6 = SplitList(List=sort_2.ValuesA, Index=expression_2)  # -> ListA, ListB
chart = CreateChart(Data="15", Names="Element emissions share for the whole building", Title=concat, ChartType=4)
chart_2 = CreateChart(Data="15", Names="CO2 emissions potential reduction", Title=concat_2, SubTitle="if your design wasnt crap", ChartType=4)
chart_3 = CreateChart(Data=panel_9, Names=panel_6, Title="STRUCTURAL ELEMENTS CO2 SCORES", SubTitle=panel_7, ChartType=1)
avr = Average(Input=demesh.Vertices)  # -> flatten(ArithmeticMean)
demesh_2 = DeconstructMesh(Mesh=split_6.ListA)  # -> simplify(Vertices), Faces, Colours, Normals
avr_2 = Average(Input=demesh_2.Vertices)  # -> flatten(ArithmeticMean)
previewmat = CustomPreviewMaterials(Geometry=display_mesh_6, DiffuseColor=display_color_6, Transparency=Slider(0.8, range=0..1))
previewmat_2 = CustomPreviewMaterials(Geometry=split_3.ListA, DiffuseColor=split_2.ListA, Transparency=Slider(0.2, range=0..1))
symadv = SymbolAdvanced(
    Style=6,
    SizePrimary=Slider(10, range=0..10),
    SizeSecondary=10,
    Rotation=0,
    Fill=split_5.ListA,
    Edge=split_5.ListA,
    Width=2,
    Adjust=False)
tag = TextTag(Location=avr, Text=split.ListA, Colour=split_2.ListA)  # disabled
tag_2 = TextTag(Location=avr_2, Text=split_4.ListA, Colour=split_5.ListA)  # disabled
symbol = SymbolDisplay(Location=avr_2, Display=symadv)
merge_3 = Merge(
    Data1=expander,
    Data2=label_3,
    Data3=listbox,
    Data4=separator_2,
    Data5=label_2,
    Data6=chart_3,
    Data7=separator,
    Data8=chart_2,
    Data9=chart,
    Data10=separator_3,
    Data13=label_4,
    Data14=slider,
    Data15=slider_2)
addelems = AddElements(Window=launchwin, Elements=flatten(merge_3), DoVLChecking=True)  # -> AddedElements, ElementNames
chartappearance = ChartAppearance(ChartToModify=chart_3, Colors=merge_2, Title=True)

# ==== cluster Cluster_2
button = Button()
toggle = BooleanToggle(False)
temporary_run_component = ClusterInput()
disable_component = ClusterInput()
all_groups = ClusterInput()
temporary_run_component_2 = Boolean(temporary_run_component)
disable_component_2 = Boolean(disable_component)
all_groups_2 = Data(all_groups)
xor = GateXor(A=disable_component_2, B=temporary_run_component_2)
gate = StreamGate(Stream=all_groups_2, Gate=xor)  # -> Target0, Target1
panel = Panel("AA")  # disabled
objfromgroup = GetObjectsInGroup()  # disabled
objbynn = GetObjectByNickname(NickName=panel)  # disabled
objfromgroup_2 = GetObjectsInGroup(Group=objbynn)  # disabled
txt = Text(["Grasshopper.Kernel.Components.GH_TextTagComponent", "Grasshopper.Kernel.Components.GH_TextTag3DComponent", "DimensionComponents.Component_AlignedDimension", "DimensionComponents.Component_LineDimension", "DimensionComponents.Component_LinearDimension", "DimensionComponents.Component_MarkerDimension", "DimensionComponents.Component_SerialDimension", "DimensionComponents.Component_AngularSimpleDimension", "DimensionComponents.Component_AngularArcDimension", "DimensionComponents.Component_AngularCircleDimension", "MathComponents.ColourComponents.Component_CreateOGLMaterial", "Grasshopper.Kernel.Components.GH_CustomPreviewComponent", "VectorComponents.PointComponents.Component_CloudDisplay", "VectorComponents.PointComponents.Component_DotDisplay", "DimensionComponents.Component_PointListDisplay", "DimensionComponents.Component_PointOrderDisplay", "VectorComponents.VectorComponents.Component_VectorDisplay", "VectorComponents.VectorComponents.Component_VectorDisplay2"])  # disabled
merge = Merge(Data1=txt, Data2=objfromgroup_2)  # -> flatten(Result); disabled

# ---- group: Karamba groups
karamba = Text(["Karamba.GHopper.Licenses.Component_License", "Karamba.GHopper.Models.Component_AssembleModel", "Karamba.GHopper.Models.Component_ConnectedParts", "Karamba.GHopper.Models.Component_DissembleModel", "Karamba.GHopper.Models.Component_ElementActivate", "Karamba.GHopper.Elements.Component_LineToBeam"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])
sofistik = Text(["gh_sofistik.General.GH_Project_Component", "gh_sofistik.General.CreateAnalysisInput", "gh_sofistik.General.GH_ReadSpreadsheet_Component", "gh_sofistik.General.TextStream", "gh_sofistik.Section.CreateAquaInput", "gh_sofistik.Section.GH_ReadSectionCdb_Component", "gh_sofistik.Section.JSON.GH_ReadSectionJSON_Component", "gh_sofistik.Section.GH_SectionFromBrep_Component", "gh_sofistik.Section.GH_CompositeSection_Component", "gh_sofistik.Section.GH_ModifySection_Component", "gh_sofistik.Section.GH_ViewSection_Component", "gh_sofistik.Structure.CreateSofimshcInput", "gh_sofistik.Structure.GH_StructuralArea_Component", "gh_sofistik.Structure.GH_StructuralLine_Component", "gh_sofistik.Structure.GH_StructuralPoint_Component", "gh_sofistik.Structure.GH_BridgeBearing_Component", "gh_sofistik.Structure.GH_ElasticCoupling_Component", "gh_sofistik.Structure.GH_Coupling_Component", "gh_sofistik.Structure.GH_Spring_Component", "gh_sofistik.Load.CreateSofiloadInput", "gh_sofistik.Load.GH_AreaLoad_Component", "gh_sofistik.Load.GH_LineLoad_Component", "gh_sofistik.Load.GH_PointLoad_Component", "gh_sofistik.Geometry.CreateGeometricAxis", "gh_sofistik.AxisModeling.GH_SecondaryAxis_Interpolator_Component", "gh_sofistik.Geometry.GH_ReadGeometricAxisCdb_Component", "gh_sofistik.Geometry.GH_ReadLandXML_Component", "gh_sofistik.Geometry.GH_CurveReparameterize_Component", "gh_sofistik.Geometry.GH_AlignmentAxis_Component", "gh_sofistik.Geometry.GH_AlignmentAxisHorizontal_Component", "gh_sofistik.Geometry.GH_AlignmentAxisVertical_Component", "gh_sofistik.AxisModeling.GH_Axis_Component", "gh_sofistik.AxisModeling.GH_AxisPlacementByParams_Component", "gh_sofistik.AxisModeling.GH_AxisPlacementByPlane_Component", "gh_sofistik.AxisModeling.GH_PlacementTransform_Component", "gh_sofistik.AxisModeling.GH_AxisVariableCustomized_Parameter", "gh_sofistik.AxisModeling.GH_EvaluateVariable_Component", "gh_sofistik.AxisModeling.GH_AxisVariableByExpression_Component", "gh_sofistik.AxisModeling.GH_AxisVariableByPoints_Component", "gh_sofistik.AxisModeling.GH_EvaluateSection_Component", "gh_sofistik.AxisModeling.GH_Curve_Interpolator_Component", "gh_sofistik.AxisModeling.GH_Solid_Interpolator_Component", "gh_sofistik.AxisModeling.GH_Face_Interpolator_Component", "gh_sofistik.Tendon.CreateTendonInput", "gh_sofistik.Tendon.GH_TendonGeometryExternal_Component", "gh_sofistik.Tendon.GH_TendonGeometrySpline_Component", "gh_sofistik.Tendon.GH_TendonGeometryStraight_Component", "gh_sofistik.Tendon.GH_TendonDefinition_Component"])
panel_2 = Panel("""Karamba
Fem
Lusas
Rfem
Sofistik""")
merge_2 = Merge(Data1=karamba, Data2=sofistik)  # -> flatten(Result)
txt_2 = Text(merge_2)
col = Colour(RGBA(225, 0, 26, 150))
data = Data(gate.Target0)
case = TextCase(Text=panel_2, Culture=127)  # -> UpperCase, LowerCase
merge_3 = Merge(Data1=panel_2, Data2=case.UpperCase, Data3=case.LowerCase)
group_names = Text(merge_3)

# ---- group: Ramboll logo and bifocals group
data_2 = Data(gate.Target0)
col_2 = Colour(RGBA(255, 255, 255, 150))
panel_3 = Panel("""Ramboll 
Template""")
selobj = GetSelectedObjects()  # -> ComponentObjects, ParamObjects, OtherObjects
txt_3 = Text(["Bifocals.BifocalsComponent", "Grasshopper.Kernel.Special.GH_Markup"])
sametype = GetObjectsOfSameType(Objects=selobj.ComponentObjects)
samelib = GetObjectsOfSameLibrary(Objects=selobj.ComponentObjects)
case_2 = TextCase(Text=panel_3, Culture=127)  # -> UpperCase, LowerCase
merge_4 = Merge(Data1=txt_3, Data2=samelib, Data3=sametype)
merge_5 = Merge(Data1=panel_3, Data2=case_2.UpperCase, Data3=case_2.LowerCase)
group_names_2 = Text(merge_5)

# ---- group: Tekla groups
col_3 = Colour(RGBA(54, 53, 69, 150))
data_3 = Data(gate.Target0)
txt_4 = Text(["GTLink.Components.CreateSteelBeamComponent", "GTLink.Components.CreateSteelBeam2PtComponent", "GTLink.Components.CreateSteelColumnComponent", "GTLink.Components.CreatePlateComponent", "GTLink.Components.CreateConcreteBeamComponent", "GTLink.Components.CreateConcreteBeam2PtComponent", "GTLink.Components.CreateConcreteColumnComponent", "GTLink.Components.CreatePadFootingComponent", "GTLink.Components.CreatePanelComponent", "GTLink.Components.CreateSlabComponent", "GTLink.Components.CreateStripFootingComponent", "GTLink.Components.CreateSingleRebarComponent", "GTLink.Components.CreateRebarGroupComponent", "GTLink.Components.ExtrudeBeamsComponent", "GTLink.Components.CreateFittingComponent", "GTLink.Components.CreateBooleanPartComponent", "GTLink.Components.CreateCutPlaneComponent", "GTLink.Components.CreateComponentComponent", "GTLink.Components.CreateGridComponent", "GTLink.Components.CreatePointComponent", "GTLink.Components.ComponentCatalogComponent", "GTLink.Components.MaterialCatalogComponent", "GTLink.Components.ProfileCatalogComponent", "GTLink.Components.ReinfocementCatalogComponent", "GTLink.Components.DeformingAttributesComponent", "GTLink.Components.NumberingAttributesComponent", "GTLink.Components.PartAttributesComponent", "GTLink.Components.PositionComponent", "GTLink.Components.CoverAttributesComponent", "GTLink.Components.RebarGroupAttributesComponent", "GTLink.Components.HookAttributesComponent", "GTLink.Components.HooksAttributesComponent", "GTLink.Components.RebarAttributesComponent", "GTLink.Components.ComponentInputComponent", "GTLink.Components.GetBeamComponent", "GTLink.Components.GetComponentComponent", "GTLink.Components.GetItemComponent", "GTLink.Components.GetModelObjectComponent", "GTLink.Components.GetPlateComponent", "GTLink.Components.GetPointComponent", "GTLink.Components.ConvertToBrepComponent", "GTLink.Components.ProfileContour"])
case_3 = TextCase(Text="Tekla", Culture=127)  # -> UpperCase, LowerCase
merge_6 = Merge(Data1="Tekla", Data2=case_3.UpperCase, Data3=case_3.LowerCase)
group_names_3 = Text(merge_6)

# ---- group: Import
import = Text(["IOComponents.Rhino3dmImporter", "IOComponents.PointImporter", "IOComponents.ShapeFileImporter", "IOComponents.PDBFileImporter", "IOComponents.ImageImporter", "Grasshopper.Kernel.Components.GH_ReadFileComponent", "Elefront.Component.Reference.Component_RefBake", "Elefront.Component.Reference.Component_RefColor", "Elefront.Component.Reference.Component_RefLayer", "Elefront.Component.Reference.Component_RefName", "Elefront.Component.Reference.Component_RefType", "Elefront.Component.Reference.Component_RefAtt"])
data_4 = Data(gate.Target0)
col_4 = Colour(RGBA(0, 78, 255, 150))
panel_4 = Panel("""Import
Imports""")
case_4 = TextCase(Text=panel_4, Culture=127)  # -> UpperCase, LowerCase
merge_7 = Merge(Data1=panel_4, Data2=case_4.UpperCase, Data3=case_4.LowerCase)
group_names_4 = Text(merge_7)

# ----
data_5 = Data(gate.Target0)
col_5 = Colour(RGBA(0, 0, 0, 38))
group = Text("Grasshopper.Kernel.Special.GH_Group")
panel_5 = Panel(""".
-""")
group_names_5 = Text(panel_5)

# ---- group: Output groups
data_6 = Data(gate.Target0)
col_6 = Colour(RGBA(137, 255, 255, 150))
panel_6 = Panel("""Output
Outputs""")
case_5 = TextCase(Text=panel_6, Culture=127)  # -> UpperCase, LowerCase
merge_8 = Merge(Data1=panel_6, Data2=case_5.UpperCase, Data3=case_5.LowerCase)
group_names_6 = Text(merge_8)

# ---- group: Input groups
txt_5 = Text(["Grasshopper.Kernel.Special.GH_NumberSlider", "Grasshopper.Kernel.Special.GH_BooleanToggle", "Grasshopper.Kernel.Special.GH_DialKnob", "Grasshopper.Kernel.Special.GH_DigitScroller", "Grasshopper.Kernel.Special.GH_ValueList", "Grasshopper.Kernel.Special.GH_ButtonObject", "Grasshopper.Kernel.Special.GH_MultiDimensionalSlider", "Grasshopper.Kernel.Special.GH_GradientControl", "Grasshopper.Kernel.Special.GH_ImageSampler", "MathComponents.TimeComponents.CalendarObject", "MathComponents.TimeComponents.ClockObject", "Grasshopper.Kernel.Special.GH_ColourPickerObject", "Grasshopper.Kernel.Special.GH_ColourSwatch", "Grasshopper.Kernel.Special.GH_ColourWheel", "Grasshopper.Kernel.Special.GH_GraphMapper", "IOComponents.AtomExtractor", "IOComponents.Rhino3dmImporter", "IOComponents.PointImporter", "IOComponents.ImageImporter", "IOComponents.PDBFileImporter", "IOComponents.ShapeFileImporter", "IOComponents.ReferencedObjectDetailsComponent", "Grasshopper.Kernel.Components.GH_ReadFileComponent"])
col_7 = Colour(RGBA(0, 0, 255, 150))
data_7 = Data(gate.Target0)
panel_7 = Panel("""Inputs
Input""")
panel_8 = Panel("""Inputs
Input
INPUT
INPUTS
input
inputs""")
case_6 = TextCase(Text=panel_7, Culture=127)  # -> UpperCase, LowerCase
merge_9 = Merge(Data1=panel_7, Data2=case_6.UpperCase, Data3=case_6.LowerCase)
group_names_7 = Text(merge_9)

# ---- group: Export
data_8 = Data(gate.Target0)
col_8 = Colour(RGBA(118, 0, 255, 150))
export = Text(["LunchBox.WF_Bake", "LunchBox.WF_Save", "Elefront.Component.Attributes.BakeAtt", "Elefront.Component.Attributes.Component_BakeLayer"])
panel_9 = Panel("""Export
Exports""")
case_7 = TextCase(Text=panel_9, Culture=127)  # -> UpperCase, LowerCase
merge_10 = Merge(Data1=panel_9, Data2=case_7.UpperCase, Data3=case_7.LowerCase)
group_names_8 = Text(merge_10)

# ---- group: Custom preview groups
col_9 = Colour(RGBA(255, 0, 255, 150))
data_9 = Data(gate.Target0)
txt_6 = Text(["Grasshopper.Kernel.Components.GH_TextTagComponent", "Grasshopper.Kernel.Components.GH_TextTag3DComponent", "DimensionComponents.Component_AlignedDimension", "DimensionComponents.Component_LineDimension", "DimensionComponents.Component_LinearDimension", "DimensionComponents.Component_MarkerDimension", "DimensionComponents.Component_SerialDimension", "DimensionComponents.Component_AngularSimpleDimension", "DimensionComponents.Component_AngularArcDimension", "DimensionComponents.Component_AngularCircleDimension", "MathComponents.ColourComponents.Component_CreateOGLMaterial", "Grasshopper.Kernel.Components.GH_CustomPreviewComponent", "VectorComponents.PointComponents.Component_CloudDisplay", "VectorComponents.PointComponents.Component_DotDisplay", "DimensionComponents.Component_PointListDisplay", "DimensionComponents.Component_PointOrderDisplay", "VectorComponents.VectorComponents.Component_VectorDisplay", "VectorComponents.VectorComponents.Component_VectorDisplay2", "Human.CustomPreviewLineWeights", "Human.CurveToScreen", "Human.PointToScreen", "Human.ScreenOrientedMesh", "Human.ScreenToWorldTag", "Human.CustomPreviewMaterials", "Human.MeshToScreen", "Human.TextToScreen", "Human.ScreenOrientedText"])
panel_10 = Panel("""Preview
Visualisation
Visualization""")
case_8 = TextCase(Text=panel_10, Culture=127)  # -> UpperCase, LowerCase
merge_11 = Merge(Data1=panel_10, Data2=case_8.UpperCase, Data3=case_8.LowerCase)
group_names_9 = Text(merge_11)

# ---- group: Excel groups
data_10 = Data(gate.Target0)
txt_7 = Text(["CORE.Grasshopper.Toolbox.readExcelSheet", "CORE.Grasshopper.Toolbox.writeToExcel", "CORE.Grasshopper.Toolbox.WriteOptions"])
col_10 = Colour(RGBA(33, 115, 70, 150))
case_9 = TextCase(Text="Excel", Culture=127)  # -> UpperCase, LowerCase
merge_12 = Merge(Data1="Excel", Data2=case_9.UpperCase, Data3=case_9.LowerCase)
group_names_10 = Text(merge_12)

# ----
entwine = Entwine(
    Branch00=group_names,
    Branch01=group_names_3,
    Branch02=group_names_10,
    Branch03=group_names_9,
    Branch04=group_names_2,
    Branch05=group_names_7,
    Branch06=group_names_6,
    Branch07=group_names_5,
    Branch08=group_names_8,
    Branch09=group_names_4,
    FlattenInputs=True)
R = ClusterOutput(entwine)
all_group_names = Text(flatten(entwine))

# ---- group: Karamba groups (continued)
all_group_names_2 = Text(all_group_names)
cluster = Cluster(
    all_groups=data,
    objects=txt_2,
    colour=col,
    group_names=merge_3,
    all_group_names=all_group_names_2,
    color_groups_of_groups=Toggle(True))  # -> groups_2, already_colored
txt_8 = Text(cluster.groups_2)

# ----
group_coloring_rules = Boolean(cluster.already_colored)

# ---- group: Tekla groups (continued)
group_coloring_rules_2 = Boolean(group_coloring_rules)
all_group_names_3 = Text(all_group_names)
cluster_2 = Cluster(
    all_groups=data_3,
    objects=txt_4,
    colour=col_3,
    group_names=merge_6,
    all_group_names=all_group_names_3,
    other_groups_coloring_rules=group_coloring_rules_2,
    color_groups_of_groups=Toggle(True))  # -> groups_2, already_colored
group_coloring_rules_3 = Boolean(cluster_2.already_colored)
txt_9 = Text(cluster_2.groups_2)

# ---- group: Excel groups (continued)
group_coloring_rules_4 = Boolean(group_coloring_rules_3)
all_group_names_4 = Text(all_group_names)
cluster_3 = Cluster(
    all_groups=data_10,
    objects=txt_7,
    colour=col_10,
    group_names=merge_12,
    all_group_names=all_group_names_4,
    other_groups_coloring_rules=group_coloring_rules_4,
    color_groups_of_groups=Toggle(True))  # -> groups_2, already_colored
group_coloring_rules_5 = Boolean(cluster_3.already_colored)
txt_10 = Text(cluster_3.groups_2)

# ---- group: Custom preview groups (continued)
group_coloring_rules_6 = Boolean(group_coloring_rules_5)
all_group_names_5 = Text(all_group_names)
cluster_4 = Cluster(
    all_groups=data_9,
    objects=txt_6,
    colour=col_9,
    group_names=merge_11,
    all_group_names=all_group_names_5,
    other_groups_coloring_rules=group_coloring_rules_6)  # -> groups_2, already_colored
txt_11 = Text(cluster_4.groups_2)
group_coloring_rules_7 = Boolean(cluster_4.already_colored)

# ---- group: Export (continued)
group_coloring_rules_8 = Boolean(group_coloring_rules_7)
all_group_names_6 = Text(all_group_names)
cluster_5 = Cluster(
    all_groups=data_8,
    objects=export,
    colour=col_8,
    group_names=merge_10,
    all_group_names=all_group_names_6,
    other_groups_coloring_rules=group_coloring_rules_8)  # -> groups_2, already_colored
group_coloring_rules_9 = Boolean(cluster_5.already_colored)
txt_12 = Text(cluster_5.groups_2)

# ---- group: Import (continued)
group_coloring_rules_10 = Boolean(group_coloring_rules_9)
all_group_names_7 = Text(all_group_names)
cluster_6 = Cluster(
    all_groups=data_4,
    objects=import,
    colour=col_4,
    group_names=merge_7,
    all_group_names=all_group_names_7,
    other_groups_coloring_rules=group_coloring_rules_10)  # -> groups_2, already_colored
group_coloring_rules_11 = Boolean(cluster_6.already_colored)
txt_13 = Text(cluster_6.groups_2)

# ---- group: Output groups (continued)
group_coloring_rules_12 = Boolean(group_coloring_rules_11)
all_group_names_8 = Text(all_group_names)
cluster_7 = Cluster(
    all_groups=data_6,
    colour=col_6,
    group_names=merge_8,
    all_group_names=all_group_names_8,
    other_groups_coloring_rules=group_coloring_rules_12)  # -> groups_2, already_colored
group_coloring_rules_13 = Boolean(cluster_7.already_colored)
txt_14 = Text(cluster_7.groups_2)

# ----
group_coloring_rules_14 = Boolean(group_coloring_rules_13)
all_group_names_9 = Text(all_group_names)
cluster_8 = Cluster(
    all_groups=data_5,
    colour=col_5,
    group_names=panel_5,
    all_group_names=all_group_names_9,
    other_groups_coloring_rules=group_coloring_rules_14)  # -> groups_2, already_colored
group_coloring_rules_15 = Boolean(cluster_8.already_colored)
txt_15 = Text(cluster_8.groups_2)

# ---- group: Input groups (continued)
group_coloring_rules_16 = Boolean(group_coloring_rules_15)
all_group_names_10 = Text(all_group_names)
cluster_9 = Cluster(
    all_groups=data_7,
    objects=txt_5,
    colour=col_7,
    group_names=merge_9,
    all_group_names=all_group_names_10,
    other_groups_coloring_rules=group_coloring_rules_16)  # -> groups_2, already_colored
group_coloring_rules_17 = Boolean(cluster_9.already_colored)
txt_16 = Text(cluster_9.groups_2)

# ---- group: Ramboll logo and bifocals group (continued)
group_coloring_rules_18 = Boolean(group_coloring_rules_17)
all_group_names_11 = Text(all_group_names)
cluster_10 = Cluster(
    all_groups=data_2,
    objects=merge_4,
    colour=col_2,
    group_names=merge_5,
    all_group_names=all_group_names_11,
    other_groups_coloring_rules=group_coloring_rules_18)  # -> groups_2, already_colored
group_coloring_rules_19 = Boolean(cluster_10.already_colored)
txt_17 = Text(cluster_10.groups_2)

# ---- group: Other groups
data_11 = Data(gate.Target0)
col_11 = Colour(RGBA(0, 0, 0, 38))
merge_13 = Merge(
    Data1=txt_8,
    Data2=txt_9,
    Data3=txt_10,
    Data4=txt_11,
    Data5=txt_17,
    Data7=txt_16,
    Data8=txt_14,
    Data9=txt_15,
    Data10=txt_12,
    Data11=txt_13)
tstat = TreeStatistics(Tree=merge_13)  # -> Paths, Length, Count
split = SplitTree(Data=simplify(graft(data_11)), Masks=flatten(tstat.Paths))  # -> Positive, Negative
setgroup = SetGroupProperties(Group=split.Negative, Color=col_11)

# ==== cluster Cluster
color_groups_of_groups = ClusterInput()  # Color Groups of groups?

other_groups_coloring_rules = ClusterInput()  # Other groups coloring rules
all_group_names = ClusterInput()  # All Group names
all_groups = ClusterInput()
group_names = ClusterInput()
objects = ClusterInput()
colour = ClusterInput()

bool = Boolean(color_groups_of_groups)
all_group_names_2 = Text(all_group_names)
group_names_2 = Text(group_names)
all_groups_2 = Data(all_groups)
bool_2 = Boolean(other_groups_coloring_rules)
objects_2 = Text(objects)
colour_2 = Colour(colour)

bool_3 = Boolean(bool)
null = NullItem(Item=bool_3)  # -> NullFlags, InvalidFlags, Description
filter = StreamFilter(Gate=null.InvalidFlags, Stream0=bool_3, Stream1=Toggle(False))
color_groups_of_groups_2 = Boolean(filter)

# ----
# Dos the groups has a name from the name list?
group_names_3 = Text(group_names_2)
all_groups_3 = Data(all_groups_2)
all_group_names_3 = Text(all_group_names_2)
object_info = ObjectInfo(Objects=all_groups_3)  # -> Name, NickName, Type, Pivot, Bounds, Value, Enabled, Preview
eval = Evaluate(F="Contains(x, y)", x=graft(object_info.NickName), y=all_group_names_3)
eval_2 = Evaluate(F="Contains(x, y)", x=graft(object_info.NickName), y=group_names_3)
ma = MassAddition(Input=eval_2)  # -> Result, PartialResults
ma_2 = MassAddition(Input=eval)  # -> Result, PartialResults
len = TextLength(Text=object_info.NickName)
group_has_matching_name = Boolean(simplify(ma.Result))
group_has_matching_all_name = Boolean(simplify(ma_2.Result))
group_has_name = Boolean(simplify(graft(len)))

# ----
# Does the group has objects from the object list?
all_groups_4 = Data(all_groups_2)
objects_3 = Text(objects)
objfromgroup = GetObjectsInGroup(Group=all_groups_4)  # -> simplify(Objects)
txt = Text(objfromgroup)
intersection = SetIntersection(SetA=txt, SetB=objects_3)
lng = ListLength(List=intersection)
group_has_object_bool = Boolean(lng)

objects_4 = Text(objects_2)
null_2 = NullItem(Item=objects_4)  # -> NullFlags, InvalidFlags, Description
ma_3 = MassAddition(Input=null_2.InvalidFlags)  # -> Result, PartialResults
bool_4 = Boolean(simplify(ma_3.Result))

# ----
# Does the group contains other groups?
all_groups_5 = Data(all_groups_2)
objfromgroup_2 = GetObjectsInGroup(Group=all_groups_5)  # -> simplify(Objects)
object_info_2 = ObjectInfo(Objects=objfromgroup_2)  # -> Name, NickName, Type, Pivot, Bounds, Value, Enabled, Preview
txt_2 = Text(flatten(object_info_2.Name))
# Changes colour of the group that includes the input objects.
panel = Panel(txt_2)
expression = Expression(x=panel, y="Group", Expression="Contains(x,y)")
unflatten = UnflattenTree(Tree=expression, Guide=object_info_2.Name)
ma_4 = MassAddition(Input=unflatten)  # -> Result, PartialResults
larger = LargerThan(FirstNumber=ma_4.Result, SecondNumber="0")  # -> LargerThan, OrEqualTo
other_groups_contained = Boolean(larger.LargerThan)

other_groups_contained_2 = Boolean(other_groups_contained)
color_the_group = Boolean(group_has_object_bool)
color_groups_of_groups_3 = Boolean(color_groups_of_groups_2)
python = GhPythonScript(x=color_the_group, y=other_groups_contained_2)  # -> out, a; inputs x: Boolean, y: Boolean
# ---------- python: Python ----------
__author__ = "AUGC"
__version__ = "2020.08.16"

import rhinoscriptsyntax as rs
import Rhino.Geometry as rg 
if x and not y: 
    a= 1
else :
    a= 0
# ---------- end python ----------
bool_5 = Boolean(python.a)
filter_2 = StreamFilter(Gate=color_groups_of_groups_3, Stream0=bool_5, Stream1=color_the_group)
color_the_group_2 = Boolean(filter_2)

# ----
# Give priority to the naming (If the group has a Name from the
# All name list, the objects it contains are ignored)
toggle = BooleanToggle(False)
group_has_matching_name_2 = Boolean(simplify(group_has_matching_name))
group_has_matching_all_name_2 = Boolean(simplify(group_has_matching_all_name))
group_has_object_bool_2 = Boolean(simplify(color_the_group_2))
long = LongestList(ListA=group_has_object_bool_2, ListB=toggle, PaddingMode=2)  # -> ListA, ListB
p_n_c = PickNChoose(Pattern=group_has_matching_all_name_2, Stream0=group_has_object_bool_2, Stream1=long.ListB)
or = GateOr(A=p_n_c, B=group_has_matching_name_2)
bool_6 = Boolean(simplify(bool_4))
filter_3 = StreamFilter(Gate=bool_6, Stream0=or, Stream1=group_has_matching_name_2)
color_the_group_3 = Boolean(filter_3)

# ----
# Has the groups already been colored by a color of higher priority
bool_7 = Boolean(bool_2)
bool_8 = Boolean(color_the_group_3)
null_3 = NullItem(Item=bool_7)  # -> NullFlags, flatten(InvalidFlags), Description
long_2 = LongestList(ListA=bool_8, ListB=Toggle(False), PaddingMode=2)  # -> ListA, ListB
item = ListItem(List=null_3.InvalidFlags, Index=0, Wrap=True)
filter_4 = StreamFilter(Gate=item, Stream0=bool_7, Stream1=long_2.ListB)

# ----
# Color the group?
# + update list of colored groups
bool_9 = Boolean(filter_4)
bool_10 = Boolean(color_the_group_3)
expression_2 = Expression(x=bool_9, y=bool_10, Expression="if(x=TRUE,FALSE,y)")
or_2 = GateOr(A=bool_10, B=bool_9)

bool_11 = Boolean(expression_2)
dispatch = Dispatch(List=simplify(graft(all_groups_2)), DispatchPattern=bool_11)  # -> ListA, ListB
clean = CleanTree(RemoveNulls=True, RemoveInvalid=True, RemoveEmpty=True, Tree=dispatch.ListA)
object_info_3 = ObjectInfo(Objects=clean)  # -> Name, NickName, Type, Pivot, Bounds, Value, Enabled, Preview
setgroup = SetGroupProperties(Group=clean, Color=colour_2)
groups = Text(object_info_3.Type)
bool_12 = Boolean(or_2)
groups_2 = ClusterOutput(groups)
already_colored = ClusterOutput(bool_12)  # Already Colored ?
