# Grasshopper definition Snitch.gh (Grasshopper 1.0.7)
# plug-ins: Grasshopper-Tekla Link 2021.1.12, jSwan, Heteroptera, SnitchGrasshopper, Wombat, Kangaroo2 Components, Pufferfish, Human, Human UI

model_object = ModelObject(
    [null x238],
    ModelID="Snitch.db1",
    ModelObjectInfos=["Tekla.Structures.Model.Assembly, Tekla.Structures.Model, Version=2021.0.0.0, Culture=neutral, PublicKeyToken=2f04dbe497b71114;48ce42d7-63e0-476d-bb43-c1b352a02531", "Tekla.Structures.Model.Assembly, Tekla.Structures.Model, Version=2021.0.0.0, Culture=neutral, PublicKeyToken=2f04dbe497b71114;877c3ea7-cfd5-414a-8960-e806691aeb64", "Tekla.Structures.Model.Assembly, Tekla.Structures.Model, Version=2021.0.0.0, Culture=neutral, PublicKeyToken=2f04dbe497b71114;ae333dfa-e25a-4bf6-955a-e3d587d47aa6", "Tekla.Structures.Model.Assembly, Tekla.Structures.Model, Version=2021.0.0.0, Culture=neutral, PublicKeyToken=2f04dbe497b71114;1b6268c6-df51-4497-b478-83930c5198a3", "Tekla.Structures.Model.Assembly, Tekla.Structures.Model, Version=2021.0.0.0, Culture=neutral, PublicKeyToken=2f04dbe497b71114;636c2c92-7f2e-4fa5-842b-a963484828f8", "Tekla.Structures.Model.Assembly, Tekla.Structures.Model, Version=2021.0.0.0, Culture=neutral, PublicKeyToken=2f04dbe497b71114;2663a38d-5e7b-407f-a34d-ffc1d9246f67"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])
model_object_2 = ModelObject(simplify(graft(model_object)))
deconstruct_assembly = DeconstructAssembly(Assembly=model_object_2)  # -> Name, Type, MainPart, Secondaries, AllObjects
shift_paths = ShiftPaths(Data=deconstruct_assembly.AllObjects, Offset=-1)
clean_tree = CleanTree(RemoveNulls=True, RemoveInvalid=True, RemoveEmpty=True, Tree=shift_paths)
cull_index = CullIndex(List=clean_tree, Indices="0", Wrap=True)
list_item = ListItem(List=clean_tree, Index="0", Wrap=True)
panel = Panel(clean_tree)

# ---- group: Rebars
rebar = Rebar(cull_index)
shift_paths_2 = ShiftPaths(Data=rebar, Offset=-1)
get_property = GetProperty(TeklaObject=shift_paths_2, Name="WEIGHT", Type=0)
shift_paths_3 = ShiftPaths(Data=get_property, Offset=-1)
mass_addition = MassAddition(Input=shift_paths_3)  # -> Result, PartialResults

# ---- group: Beam and columns
beam = Beam(list_item)
clean_tree_2 = CleanTree(RemoveNulls=True, RemoveInvalid=True, RemoveEmpty=True, Tree=beam)
convert_to_mesh = ConvertToMesh(TeklaObject=clean_tree_2, SolidType=2)
deconstruct_beam = DeconstructBeam(Beam=clean_tree_2)  # -> Curve, Profile, Attributes, Position, Numbering, Deforming, Type
expand_part_attributes = ExpandPartAttributes(Attributes=deconstruct_beam.Attributes)  # -> Name, Profile, Material, Finish, Class, Phase, UDA
shift_paths_4 = ShiftPaths(Data=convert_to_mesh, Offset=-1)
control_points = ControlPoints(Curve=deconstruct_beam.Curve)  # -> Points, Weights, Knots
match_text = MatchText(Text=deconstruct_beam.Type, Pattern="BEAM", Case=True)
volume = Volume(Geometry=shift_paths_4)  # -> expr("x*10^-9", Volume), Centroid
match_text_2 = MatchText(Text=deconstruct_beam.Type, Pattern="COLUMN", Case=True)
shift_paths_5 = ShiftPaths(Data=control_points.Points, Offset=-1)
dispatch = Dispatch(List=deconstruct_beam.Curve, DispatchPattern=match_text)  # -> ListA, ListB
dispatch_2 = Dispatch(List=volume.Volume, DispatchPattern=match_text_2)  # -> ListA, ListB
dispatch_3 = Dispatch(List=expand_part_attributes.Material, DispatchPattern=match_text_2)  # -> ListA, ListB
dispatch_4 = Dispatch(List=shift_paths_4, DispatchPattern=match_text)  # -> ListA, ListB
dispatch_5 = Dispatch(List=deconstruct_beam.Curve, DispatchPattern=match_text_2)  # -> ListA, ListB
tree_statistics = TreeStatistics(Tree=dispatch_5.ListA)  # -> Paths, Length, Count
dispatch_6 = Dispatch(List=shift_paths_4, DispatchPattern=match_text_2)  # -> ListA, ListB
dispatch_7 = Dispatch(List=expand_part_attributes.Material, DispatchPattern=match_text)  # -> ListA, ListB
dispatch_8 = Dispatch(List=volume.Volume, DispatchPattern=match_text_2)  # -> ListA, ListB
dispatch_9 = Dispatch(List=volume.Volume, DispatchPattern=match_text)  # -> ListA, ListB
tree_statistics_2 = TreeStatistics(Tree=dispatch.ListA)  # -> Paths, Length, Count
dispatch_10 = Dispatch(List=volume.Volume, DispatchPattern=match_text)  # -> ListA, ListB
tree_branch = TreeBranch(Tree=mass_addition.Result, Path=tree_statistics.Paths, MaintainPaths=True)
panel_2 = Panel("50")
tree_branch_2 = TreeBranch(Tree=mass_addition.Result, Path=tree_statistics_2.Paths, MaintainPaths=True)
snitch_beam = SnitchBeam(
    Mesh=dispatch_4.ListA,
    Polyline=dispatch.ListA,
    ConcreteVolume=dispatch_10.ListA,
    SteelMass=tree_branch_2,
    ConcreteClass=dispatch_7.ListA,
    Load="40")

# ----
panel_3 = Panel(mass_addition.Result)
longest_list = LongestList(ListListA=dispatch_6.ListA, ListListB=panel_2, PaddingMode=2)  # -> ListListA, flatten(ListListB)
randomize_numbers = RandomizeNumbers(Number=longest_list.ListListB, Ratio=0.2)
unflatten_tree = UnflattenTree(Tree=randomize_numbers, Guide=longest_list.ListListA)
snitch_column = SnitchColumn(
    Mesh=dispatch_6.ListA,
    Polyline=dispatch_5.ListA,
    ConcreteVolume=dispatch_2.ListA,
    SteelMass=tree_branch,
    ConcreteClass=dispatch_3.ListA,
    Load=unflatten_tree)
panel_4 = Panel(dispatch_2.ListA)
panel_5 = Panel("1")  # disabled
panel_6 = Panel("0")  # disabled
panel_7 = Panel("C:\Users\AUGC\source\repos\Snitcher\SnitchGrasshopper\Resources\DogSniffingImage.png")
panel_8 = Panel("""Snitch is an AI powered tool that will help you spot 
crappy design""")
panel_9 = Panel("""0
25
50
75
100""")
consec = ConsecutiveDomains(Numbers=panel_9, Additive=False)
display_worst_cases = Slider(50, range=0..100)
tag_worst_cases = Slider(5, range=0..100)
# Total CO2 per element type
panel_10 = Panel("500")
image = CreateImage(ImageSource=panel_7, ImageWidth=panel_10)
label = CreateLabel(LabelText=panel_8, LabelSize=18, Justification=0)
panel_11 = Panel("""GOOD
SO SO 
NOT SO GOOD
DOG POOP""")
panel_12 = Panel("The grades ave been generated with a database of CO2 optimised projects")
merge = Merge(Data1=label, Data2=image)
expander = CreateExpander(UIElements=merge, Header="WHAT IS SNITCH?", Open=False)
panel_13 = Panel("15")
panel_14 = Panel("""All
Columns
Slab""")
slider = CreateSlider(
    Slider=display_worst_cases,
    SnapValue="10",
    ShowBounds=True,
    ShowTicks=False,
    ShowTooltip=False,
    ShowValLabel=True,
    showLabel=True)
slider_2 = CreateSlider(
    Slider=tag_worst_cases,
    SnapValue="5",
    ShowBounds=True,
    ShowTicks=False,
    ShowTooltip=False,
    ShowValLabel=True,
    showLabel=True)
label_2 = CreateLabel(LabelText="YOU HAVE BEEN SNITCHED", LabelSize=18, Justification=1)
swatch = ColourSwatch(SwatchColor=RGB(58, 255, 255))
separator = CreateSeparator(Thickness=0.5, Horizontal=True, Color=RGB(0, 0, 0))
listbox = CreateListBox(ListItems=panel_14, SelectedIndex=0, Height=100)
separator_2 = CreateSeparator(Thickness=0.5, Horizontal=True, Color=RGB(0, 0, 0))
label_3 = CreateLabel(LabelText="WANNA SNITCH?", LabelSize=24, Justification=1)
launchwin = LaunchWindow(Show=Toggle(True), Name="SNITCH", Width="600", Height="900", ChildStatus=2, EnableHorizScroll=False)
label_4 = CreateLabel(LabelText="Display settings", LabelSize=18, Justification=1)
separator_3 = CreateSeparator(Thickness=0.5, Horizontal=True, Color=RGB(0, 0, 0))
values = ValueListener(Elements=slider, SomeProperty=True)  # -> Values, Indices
values_2 = ValueListener(Elements=slider_2, SomeProperty=True)  # -> Values, Indices
values_3 = ValueListener(Elements=listbox, SomeProperty=True)  # -> Values, Indices
merge_2 = Merge(
    Data1=ColourSwatch(SwatchColor=RGB(75, 214, 0)),
    Data2=ColourSwatch(SwatchColor=RGB(247, 255, 0)),
    Data3=ColourSwatch(SwatchColor=RGB(255, 119, 0)),
    Data4=ColourSwatch(SwatchColor=RGB(255, 0, 0)))
display_value = Data(values_3.Values)
display_value_2 = Data(display_value)
python = GhPythonScript(x=display_value_2)  # -> out, a
# ---------- python: Python ----------
__author__ = "AUGC"
__version__ = "2023.04.15"

import rhinoscriptsyntax as rs
print(x)
if x == "Columns": 
    a=0
elif x == "Slab": 
    a=1
elif x == "Core": 
    a=2
elif x == "All": 
    a=3
print(a)
# ---------- end python ----------
display_value_3 = Data(display_value)
display_value_4 = Data(display_value)
concat = Concatenate(FragmentA=display_value_4, FragmentB=" Emissions Savings: ", FragmentC="XXt (CO2eq)")
chart = CreateChart(Data="15", Names="CO2 emissions potential reduction", Title=concat, SubTitle="if your design wasnt crap", ChartType=4)  # disabled

# ---- group: Slabs
plate = Plate(list_item)
clean_tree_3 = CleanTree(RemoveNulls=True, RemoveInvalid=True, RemoveEmpty=True, Tree=plate)
convert_to_mesh_2 = ConvertToMesh(TeklaObject=clean_tree_3, SolidType=2)
deconstruct_plate = DeconstructPlate(Plate=clean_tree_3)  # -> Boundary, Profile, Attributes, Position, Numbering, Type
expand_part_attributes_2 = ExpandPartAttributes(Attributes=deconstruct_plate.Attributes)  # -> Name, Profile, Material, Finish, Class, Phase, UDA
control_points_2 = ControlPoints(Curve=deconstruct_plate.Boundary)  # -> Points, Weights, Knots
shift_paths_6 = ShiftPaths(Data=convert_to_mesh_2, Offset=-1)
panel_15 = Panel("PLATE")
volume_2 = Volume(Geometry=shift_paths_6)  # -> expr("x*10^-9", Volume), Centroid
shift_paths_7 = ShiftPaths(Data=control_points_2.Points, Offset=-1)
panel_16 = Panel("1")
tree_statistics_3 = TreeStatistics(Tree=clean_tree_3)  # -> Paths, Length, Count
tree_branch_3 = TreeBranch(Tree=mass_addition.Result, Path=tree_statistics_3.Paths, MaintainPaths=True)

# ---- group: Voronoi
curve = Curve(deconstruct_plate.Boundary)
end_points = EndPoints(Curve=deconstruct_beam.Curve)  # -> Start, End
c_script = CSharpScript(curves=flatten(curve))  # -> graft(A); inputs curves: list of Curve
# ---------- c_script: C# ----------
    List<helper> newCurves = new List<helper>();
    
    foreach (var curve in curves)
    {
      Plane normal;
      curve.TryGetPlane(out normal, 0.001);
      if (normal.ZAxis.Z > 0.9)
      {
        newCurves.Add(new helper(){curve = curve, Ele = normal.Origin.Z});
      }
       
    }
    newCurves.Sort((x,y) => x.Ele.CompareTo(y.Ele));
    List<Curve> final = new List<Curve>();
    foreach (var item in newCurves)
    {
      final.Add(item.curve);
    }
    A = final;
# ---------- c_script: C# additional code ----------
  public class helper
  {
    public double Ele {get;set;}
    public Curve curve {get;set;}
  }
# ---------- end c_script ----------
boundary_surfaces = BoundarySurfaces(Edges=c_script)
removeduplicatepts = RemoveDuplicatePts(Points=flatten([end_points.Start, end_points.End]), Tolerance=0.01)
brep_closest_point = BrepClosestPoint(Point=removeduplicatepts, Brep=boundary_surfaces)  # -> Point, Normal, Distance
equality = Equality(FirstNumber=simplify(brep_closest_point.Point), SecondNumber=2)  # -> Equality, Inequality
smaller_than = SmallerThan(FirstNumber=brep_closest_point.Distance, SecondNumber="10")  # -> SmallerThan, OrEqualTo
cull_pattern = CullPattern(List=removeduplicatepts, CullPattern=smaller_than.SmallerThan)  # -> simplify(List)
voronoi = Voronoi(Points=cull_pattern, BruteForceOverride=False)
merge_3 = Merge(Data1=simplify(c_script), Data2=simplify(voronoi))
is_planar = IsPlanar(Surface=boundary_surfaces, Interior=True)  # -> Planar, Plane
panel_17 = Panel(cull_pattern)
region_intersection = RegionIntersection(CurvesA=simplify(c_script), CurvesB=simplify(voronoi), Plane=is_planar.Plane)
region_union = RegionUnion(Curves=merge_3)
trim_with_region = TrimWithRegion(Curve=simplify(voronoi), Region=simplify(c_script))  # -> Inside, Outside
shift_paths_8 = ShiftPaths(Data=trim_with_region.Inside, Offset=-1)
curve_2 = Curve(shift_paths_8)
close_curve = CloseCurve(Curve=curve_2, CloseType=0, Bulge=0.5, Tolerance=0)  # -> Closed, ResultBoolean

# ----
longest_list_2 = LongestList(ListListA=tree_branch_3, ListListB="2", PaddingMode=2)  # -> ListListA, flatten(ListListB)
randomize_numbers_2 = RandomizeNumbers(Number=longest_list_2.ListListB, Ratio=0.2)
unflatten_tree_2 = UnflattenTree(Tree=randomize_numbers_2, Guide=longest_list_2.ListListA)

# ---- group: Slabs (continued)
snitch_slab = SnitchSlab(
    Mesh=shift_paths_6,
    Polyline=deconstruct_plate.Boundary,
    ConcreteVolume=volume_2.Volume,
    SteelMass=tree_branch_3,
    ConcreteClass=expand_part_attributes_2.Material,
    Thickness=expand_part_attributes_2.Profile,
    Load=unflatten_tree_2)

# ----
merge_4 = Merge(Data1=snitch_beam, Data2=snitch_column, Data3=snitch_slab)  # -> flatten(Result)
snitch_building = SnitchBuilding(ListOfBuildingObjects=merge_4, Voronois=close_curve.Closed)

# ---- group: Create JSON database
snitchobject = Data(snitch_building)
serialize_json = SerializeJson(SnitchObject=snitchobject, IncludeNullAndEmptyProperties=False)  # disabled
serialize_json_2 = SerializeJson(Building=snitchobject, IncludeNullAndEmptyProperties=False)
c_script_2 = CSharpScript()  # -> CurrentFolder
# ---------- c_script_2: C# usings ----------
using System.IO;
# ---------- c_script_2: C# ----------
    CurrentFolder = Path.GetDirectoryName(GrasshopperDocument.FilePath) + Path.DirectorySeparatorChar;
# ---------- end c_script_2 ----------
text_join = TextJoin(Text=serialize_json, Join=",")
create_json = BooleanToggle(False)
deserialize_json = DeserializeJson(JSON=serialize_json_2, OutputsLocked=False)
concatenate = Concatenate(FragmentA=c_script_2, FragmentB="Database.json")
concatenate_2 = Concatenate(FragmentA="[", FragmentB=text_join, FragmentC="]")
write_to_text_file = WriteToTextFile(Run=create_json, TextToWrite=deserialize_json, FilePath=concatenate, Append=Toggle(False), NewOnly=False)
panel_18 = Panel(write_to_text_file)

# ----
analyze_snitch_building = AnalyzeSnitchBuilding(Building=snitch_building)
expand_object = ExpandObject(Object=analyze_snitch_building)  # -> Beams, BuildingObjectsList, CO2, CO2_beams, CO2_columns, CO2_slabs, CO2_total, CO2_walls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
expand_object_2 = ExpandObject(Object=expand_object.Columns)  # -> Key, Value
expand_object_3 = ExpandObject(Object=expand_object.Slabs)  # -> Key, Value
expand_object_4 = ExpandObject(Object=expand_object.CO2_columns)  # -> Concrete, Steel, Total
expand_object_5 = ExpandObject(Object=expand_object.CO2_slabs)  # -> Concrete, Steel, Total
expand_object_6 = ExpandObject(Object=expand_object.CO2_total)  # -> Concrete, Steel, Total
building_ewmissions = Data(expand_object_6.Total)
columns_emissions = Data(expand_object_4.Total)
expand_object_7 = ExpandObject(Object=expand_object_2.Value)  # -> CenterLine, CO2, ConcreteClass, FloorNo, G, Guid, Height, LoadBearingArea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
slabs_emissions = Data(expand_object_5.Total)
expand_object_8 = ExpandObject(Object=expand_object_3.Value)  # -> Boundary, CO2, ConcreteClass, FloorNo, G, Guid, Load, Mass_steel_m3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
building_ewmissions_2 = Data(building_ewmissions)
pline = PolyLine(Vertices=expand_object_8.Boundary, Closed=False)
column_centerline = Curve(expand_object_7.CenterLine)
column_mesh = Mesh(expand_object_7.Mesh)
column_score = Data(expand_object_7.Score)
slab_score = Data(expand_object_8.Score)
slab_mesh = Mesh(expand_object_8.Mesh)
slab_boundarires = Curve(pline)
panel_19 = Panel(expand_object_8.Score)
gradient = Gradient(
    LowerLimit=panel_6,
    UpperLimit=panel_5,
    Parameter=expand_object_8.Score,
    stops=[0: RGB(0, 128, 0), 0.5: RGB(255, 255, 0), 1: RGB(255, 0, 0)])  # disabled
gradient_2 = Gradient(
    LowerLimit=panel_6,
    UpperLimit=panel_5,
    Parameter=expand_object_7.Score,
    stops=[0: RGB(0, 128, 0), 0.5: RGB(255, 255, 0), 1: RGB(255, 0, 0)])  # disabled
custom_preview = CustomPreview(Geometry=slab_mesh, Material=gradient)  # disabled
custom_preview_2 = CustomPreview(Geometry=column_mesh, Material=gradient_2)  # disabled
panel_20 = Panel(expand_object_7.Score)
slab_mesh_2 = Mesh(flatten(slab_mesh))
column_mesh_2 = Mesh(flatten(column_mesh))
demesh = DeconstructMesh(Mesh=slab_mesh_2)  # -> Vertices, Faces, Colours, Normals
demesh_2 = DeconstructMesh(Mesh=column_mesh_2)  # -> Vertices, Faces, Colours, Normals
conmesh = ConstructMesh(Vertices=demesh.Vertices, Faces=demesh.Faces)
slab_boundarires_2 = Curve(flatten(slab_boundarires))
conmesh_2 = ConstructMesh(Vertices=demesh_2.Vertices, Faces=demesh_2.Faces)  # -> flatten(Mesh)
slab_score_2 = Data(flatten(slab_score))
column_centerline_2 = Curve(flatten(column_centerline))
column_mesh_3 = Mesh(flatten(column_mesh))
column_score_2 = Data(flatten(column_score))
bnd = Bounds(Numbers=column_score_2)

lng = ListLength()
crv = Curve(column_centerline_2)
random = Random(Range="0 to 100", Number=lng, Seed=2)  # -> simplify(Random)
panel_21 = Panel("0 to 100")
remap = RemapNumbers(Value=column_score_2, Source=bnd, Target="0 to 1")  # -> Mapped, Clipped
remap_2 = RemapNumbers(Value=column_score_2, Source=bnd, Target="0 to 100")  # -> Mapped, Clipped
pipe = Pipe(Curve=crv, Radius=Slider(0.35, range=0..1), Caps=0)  # -> flatten(Pipe)
bnd_2 = Bounds(Numbers=remap.Mapped)
dedomain = DeconstructDomain(Domain=bnd_2)  # -> Start, End
gradient_3 = Gradient(
    LowerLimit=dedomain.Start,
    UpperLimit=dedomain.End,
    Parameter=remap.Mapped,
    stops=[0: RGB(0, 128, 0), 0.5: RGB(255, 255, 0), 1: RGB(255, 0, 0)])
mesh = Mesh(conmesh_2)
col = Colour(gradient_3)
mcol = MeshColours(Mesh=graft(mesh), Colours=graft(col))  # -> simplify(flatten(Mesh))
display_mesh = Mesh(mesh)
display_color = Colour(col)
grade = Data(remap_2.Mapped)

previewlw = CustomPreviewLineweights(Geometry=crv, Shader=ColourSwatch(SwatchColor=RGB(0, 0, 0)), Thickness="1", Absolute=False)

bnd_3 = Bounds(Numbers=slab_score_2)

data = Data()
lng_2 = ListLength(List=data)
crv_2 = Curve(slab_boundarires_2)
pt = Point(Point(0, 0, 0.25))
random_2 = Random(Range="0 to 100", Number=lng_2, Seed=2)  # -> simplify(Random)
boundary = BoundarySurfaces(Edges=slab_boundarires_2)
Z = UnitZ(Factor=pt)
extr = Extrude(Base=boundary, Direction=Z)
remap_3 = RemapNumbers(Value=slab_score_2, Source=bnd_3, Target="0 to 1")  # -> Mapped, Clipped
remap_4 = RemapNumbers(Value=slab_score_2, Source=bnd_3, Target="0 to 100")  # -> Mapped, Clipped
bnd_4 = Bounds(Numbers=remap_3.Mapped)
dedomain_2 = DeconstructDomain(Domain=bnd_4)  # -> Start, End
gradient_4 = Gradient(
    LowerLimit=dedomain_2.Start,
    UpperLimit=dedomain_2.End,
    Parameter=remap_3.Mapped,
    stops=[0: RGB(0, 128, 0), 0.5: RGB(255, 255, 0), 1: RGB(255, 0, 0)])
mesh_2 = Mesh(conmesh)
col_2 = Colour(gradient_4)
mcol_2 = MeshColours(Mesh=graft(mesh_2), Colours=graft(col_2))  # -> simplify(flatten(Mesh))
display_mesh_2 = Mesh(mesh_2)
display_color_2 = Colour(col_2)
grade_2 = Data(remap_4.Mapped)

previewlw_2 = CustomPreviewLineweights(Geometry=crv_2, Shader=ColourSwatch(SwatchColor=RGB(0, 0, 0)), Thickness="1", Absolute=False)
preview = CustomPreview(Geometry=boundary, Material=ColourSwatch(SwatchColor=RGBA(102, 102, 102, 0)))  # disabled

building_ewmissions_3 = Data(building_ewmissions)
columns_emissions_2 = Data(columns_emissions)
slabs_emissions_2 = Data(slabs_emissions)
filter = StreamFilter(Gate=python.a, Stream0=display_color, Stream1=display_color_2, Stream3=[display_color, display_color_2])  # -> flatten(Stream)
filter_2 = StreamFilter(Gate=python.a, Stream0=grade, Stream1=grade_2, Stream3=flatten([grade, grade_2]))
filter_3 = StreamFilter(Gate=python.a, Stream0=columns_emissions_2, Stream1=slabs_emissions_2, Stream3=building_ewmissions_3)  # -> flatten(Stream)
filter_4 = StreamFilter(Gate=python.a, Stream0=display_mesh, Stream1=display_mesh_2, Stream3=[display_mesh, display_mesh_2])  # -> flatten(Stream)
display_color_3 = Colour(filter)
display_mesh_3 = Mesh(filter_4)
emissions = Data(filter_3)
grade_3 = Data(filter_2)
display_mesh_4 = Mesh(display_mesh_3)
display_color_4 = Colour(display_color_3)
grade_4 = Data(grade_3)
inc = Includes(Value=grade_4, Domain=simplify(graft(consec)))  # -> simplify(Includes), simplify(Deviation)
display_color_5 = Colour(display_color_4)
display_mesh_5 = Mesh(display_mesh_4)
grade_5 = Data(grade_4)
display_mesh_6 = Mesh(display_mesh_4)
display_color_6 = Colour(display_color_4)
grade_6 = Data(grade_4)
sort = SortList(Keys=grade_5, ValuesA=display_mesh_5, ValuesB=display_color_5)  # -> reverse(Keys), reverse(ValuesA), reverse(ValuesB)
cull = CullPattern(List=grade_4, CullPattern=inc.Includes)  # -> simplify(List)
building_ewmissions_4 = Data(building_ewmissions)
sort_2 = SortList(Keys=grade_6, ValuesA=display_mesh_6, ValuesB=display_color_6)  # -> reverse(Keys), reverse(ValuesA), reverse(ValuesB)
lng_3 = ListLength(List=cull)  # -> reverse(flatten(Length))
emissions_2 = Data(emissions)
lng_4 = ListLength(List=sort.Keys)
expression = Expression(x=building_ewmissions_4, Expression="round(x/1000,2)")
expression_2 = Expression(x=emissions_2, Expression="round(x/1000,2)")
expression_3 = Expression(x=lng_4, y=values.Values, Expression="x*y/100")
lng_5 = ListLength(List=sort_2.Keys)
expression_4 = Expression(x=lng_5, y=values_2.Values, Expression="x*y/100")
split = SplitList(List=sort.Keys, Index=expression_3)  # -> ListA, ListB
expression_5 = Expression(x=expression_2, y=expression, Expression="x/y*100")
split_2 = SplitList(List=sort.ValuesB, Index=expression_3)  # -> ListA, ListB
split_3 = SplitList(List=sort.ValuesA, Index=expression_3)  # -> ListA, ListB
concat_2 = Concatenate(FragmentA=expression_2, FragmentB="t (CO2eq)")
concat_3 = Concatenate(FragmentA=display_value_3, FragmentB=" CO2 emissions: ", FragmentC=concat_2)
split_4 = SplitList(List=sort_2.Keys, Index=expression_4)  # -> ListA, ListB
demesh_3 = DeconstructMesh(Mesh=split_3.ListA)  # -> simplify(Vertices), Faces, Colours, Normals
split_5 = SplitList(List=sort_2.ValuesB, Index=expression_4)  # -> ListA, ListB
split_6 = SplitList(List=sort_2.ValuesA, Index=expression_4)  # -> ListA, ListB
chart_2 = CreateChart(Data=expression_5, Names="Element emissions share for the whole building", Title=concat_3, ChartType=4)
chart_3 = CreateChart(Data=lng_3, Names=panel_11, Title="STRUCTURAL ELEMENTS CO2 SCORES", SubTitle=panel_12, ChartType=1)
avr = Average(Input=demesh_3.Vertices)  # -> flatten(ArithmeticMean)
demesh_4 = DeconstructMesh(Mesh=split_6.ListA)  # -> simplify(Vertices), Faces, Colours, Normals
avr_2 = Average(Input=demesh_4.Vertices)  # -> flatten(ArithmeticMean)
previewmat = CustomPreviewMaterials(Geometry=display_mesh_5, DiffuseColor=display_color_5, Transparency=Slider(0.8, range=0..1))
symadv = SymbolAdvanced(
    Style=6,
    SizePrimary=Slider(10, range=0..10),
    SizeSecondary=10,
    Rotation=0,
    Fill=split_5.ListA,
    Edge=split_5.ListA,
    Width=2,
    Adjust=False)
tag = TextTag(Location=avr, Text=split.ListA, Colour=split_2.ListA)  # disabled
previewmat_2 = CustomPreviewMaterials(Geometry=split_3.ListA, DiffuseColor=split_2.ListA, Transparency=Slider(0.2, range=0..1))
tag_2 = TextTag(Location=avr_2, Text=split_4.ListA, Colour=split_5.ListA)  # disabled
symbol = SymbolDisplay(Location=avr_2, Display=symadv)
panel_25 = Panel(split_2.ListA)
merge_5 = Merge(
    Data1=expander,
    Data2=label_3,
    Data3=listbox,
    Data4=separator_2,
    Data5=label_2,
    Data6=chart_3,
    Data7=separator,
    Data8=chart,
    Data9=flatten(chart_2),
    Data10=flatten(separator_3),
    Data13=flatten(label_4),
    Data14=flatten(slider),
    Data15=flatten(slider_2))  # -> flatten(Result)
addelems = AddElements(Window=launchwin, Elements=flatten(merge_5), DoVLChecking=True)  # -> AddedElements, ElementNames
chartappearance = ChartAppearance(ChartToModify=chart_3, Colors=merge_2, Title=True)
